# Grasshopper definition Meerkat tools.gh (Grasshopper 1.0.8)

palette = ValueList({"ladybug", "thermal", "turbo", "rdylbu", "spectral", "coolwarm", "rdbu", "viridis", "magma", "inferno"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}, selected="ladybug")
edx_reader = Python3Script()  # -> out, var_names, dims, x_levels, y_levels, z_levels, mesh, values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; inputs edx: String, var: String, k: Int32, origin: Point3d, fill: Boolean, fill_value: Double, run: Boolean
#   port axis: str - section plane: "z" = plan (default) "x" = vertical section in the YZ plane "y" = vertical section in the XZ plane
#   port unit: Unit of the variable, e.g. "°C".
# ---------- edx_reader: Python ----------
"""ENVI-met EDX/EDT reader -> mesh + values for LB Spatial Heatmap
Runs in GhPython (IronPython 2.7, Rhino 7) and Python 3 (Rhino 8).

Inputs (Type hint):
    _run    : bool  - True = read the file and build the result; False = do nothing:
                      the file is not read and all outputs are empty.
                      Connect a Boolean Toggle. Default True if the input is missing.
    _edx    : str   - path to the .EDX file (the .EDT file must share its name and folder)
    _var    : str   - variable name (or part of it, e.g. "air temp") or its index
    _axis_  : str   - section plane: "z" (plan, default), "x" (vertical section in the YZ plane),
                      "y" (vertical section in the XZ plane)
    _k      : int   - cell index along _axis_ (z: level, x: column i, y: row j)
    _origin_: Point3d (optional) - model origin in Rhino
    _decimals_: int (optional) - decimals for Min / Max text, default 2
    _wrap_  : int (optional) - max characters per line of the variable name in
                      legend_title, default 22 (longer names wrap onto several lines)
    _ascii_unit_: bool (optional) - True = write units without special characters
                      ("degC", "m3", "W/m2") for fonts that cannot show ° ² ³; default False
    _fill_  : bool (optional) - True = cells without data (buildings / no-data, -999) are
                      kept in the mesh and filled with _fill_value_; False = they are
                      removed (old behaviour). Default True
    _fill_value_: float (optional) - value used for empty cells, default 0
Outputs:
    var_names : list of variables in the file
    dims      : (nx, ny, nz)
    x_levels, y_levels, z_levels : cell-centre coordinates along each axis (m) - use to pick _k
    mesh      : grid mesh (empty cells filled with _fill_value_, or removed if _fill_ = False)
    values    : per-face values -> connect to LB Spatial Heatmap
    date      : simulation date of this output file, "YYYY-MM-DD"
    hour      : hour of this output file (int, 0-23) - e.g. for LB Analysis Period / titles
    time      : time "HH:MM" (hours and minutes, no seconds)
    datetime  : "YYYY-MM-DD HH:MM" (handy as a heatmap title)
    v_min, v_max : minimum / maximum of the REAL data (filled cells are ignored)
    filled    : list of bool per face, True = this face had no data and was filled
    unit      : unit of the variable, e.g. "°C"
    min_txt, max_txt : "28.31 °C" style text
    legend_title : multi-line title -> legend_title_ of LB Legend Parameters:
                       Variable name
                       ------------------
                       Date
                       Time
                       --------------------
                       Min: ...
                       Max: ...
    (read from <simulation_date>/<simulation_time> in the EDX header; if missing, from the
     ENVI-met file name, e.g. ..._AT_2025-06-21_14.00.01.EDX)
"""
import re
import os
from array import array
import Rhino.Geometry as rg

NODATA = -999.0


def opt(name, default=None):
    v = globals().get(name, default)
    return default if v is None else v


_run = bool(opt('_run', True))
_axis_ = opt('_axis_', 'z')
_k = opt('_k', 0)
_origin_ = opt('_origin_', None)
_decimals_ = int(opt('_decimals_', 2))
_wrap_ = max(8, int(opt('_wrap_', 22)))
_ascii_unit_ = bool(opt('_ascii_unit_', False))
_fill_ = bool(opt('_fill_', True))
_fill_value_ = float(opt('_fill_value_', 0.0))
TIPS_IN = {
    '_run': 'bool - True = read the file and build the result.\nFalse = do nothing: the file is not read and all outputs are empty.\nConnect a Boolean Toggle. Default True.',
    '_edx': 'str - full path to the ENVI-met .EDX file.\nThe .EDT file must have the same name and be in the same folder.',
    '_var': 'str - variable to read: full name, part of it (e.g. "air temp") or its index.\nSee the var_names output for the list.',
    '_axis_': 'str - section plane:\n"z" = plan (default)\n"x" = vertical section in the YZ plane\n"y" = vertical section in the XZ plane',
    '_k': 'int - cell index along _axis_ (z: level, x: column i, y: row j).\nUse x_levels / y_levels / z_levels to find the index of a height or position. Default 0.',
    '_origin_': 'Point3d (optional) - position of the ENVI-met model origin in Rhino. Default (0,0,0).',
    '_decimals_': 'int (optional) - decimals of the Min / Max texts. Default 2.',
    '_wrap_': 'int (optional) - max characters per line of the variable name in legend_title;\nlonger names wrap onto several lines. Default 22 (min 8).',
    '_ascii_unit_': 'bool (optional) - True = write units without special characters\n("degC", "m3", "W/m2") for fonts that cannot show deg / 2 / 3. Default False.',
    '_fill_': 'bool (optional) - True = cells without data (buildings / no-data, -999) are kept\nand get _fill_value_ (use the filled output to exclude them later).\nFalse = those cells are removed from the mesh. Default True.',
    '_fill_value_': 'float (optional) - value given to empty cells when _fill_ is True. Default 0.',
}
TIPS_OUT = {
    'var_names': 'List of all variables stored in the file (name + unit).',
    'dims': 'Grid size (nx, ny, nz).',
    'x_levels': 'Cell-centre x coordinates (m) - pick _k for _axis_ = "x".',
    'y_levels': 'Cell-centre y coordinates (m) - pick _k for _axis_ = "y".',
    'z_levels': 'Cell-centre heights (m) - pick _k for _axis_ = "z" (plan level).',
    'mesh': 'Grid mesh of the section, one face per ENVI-met cell\n-> _mesh of the Heatmap component.',
    'values': 'One value per mesh face -> _values of the Heatmap component (List Access).',
    'date': 'Simulation date of this output file, "YYYY-MM-DD".',
    'hour': 'Hour of this output file (int, 0-23).',
    'time': 'Time of this output file, "HH:MM".',
    'datetime': '"YYYY-MM-DD HH:MM" - handy as global title.',
    'v_min': 'Minimum of the REAL data (filled cells ignored) -> _vmin_ of the Heatmap.',
    'v_max': 'Maximum of the REAL data (filled cells ignored) -> _vmax_ of the Heatmap.',
    'unit': u'Unit of the variable, e.g. "\u00b0C".',
    'min_txt': u'Minimum as text with unit, e.g. "28.31 \u00b0C".',
    'max_txt': u'Maximum as text with unit, e.g. "36.02 \u00b0C".',
    'legend_title': 'Multi-line legend title (variable / date / time / Min / Max)\n-> _legend_title_ of the Heatmap.',
    'filled': 'One bool per face: True = the cell had no data and was filled\n-> _filled_ of the Heatmap (List Access), so buildings stay out of smoothing / contours.',
}
def set_tooltips(tips_in, tips_out, comp_desc=None):
    """write the tooltip (Description) of every input / output of this component.
    Matched by NickName; only changed when different, so it costs nothing after the first run"""
    try:
        comp = ghenv.Component  # noqa: F821
    except NameError:
        return
    try:
        if comp_desc and comp.Description != comp_desc:
            comp.Description = comp_desc
        for plist, tips in ((comp.Params.Input, tips_in), (comp.Params.Output, tips_out)):
            for p in plist:
                t = tips.get(p.NickName) or tips.get(p.Name)
                if t and p.Description != t:
                    p.Description = t
    except Exception as ex:                              # tooltips must never break the solve
        print('tooltips not set: %s' % ex)


OUTS = ('var_names', 'dims', 'x_levels', 'y_levels', 'z_levels', 'mesh', 'values',
        'date', 'hour', 'time', 'datetime', 'v_min', 'v_max', 'unit', 'min_txt', 'max_txt',
        'legend_title', 'filled')


def tag(txt, name):
    m = re.search(r'<%s>(.*?)</%s>' % (name, name), txt, re.S | re.I)
    return m.group(1).strip() if m else None


def floats(s):
    return [float(v) for v in s.replace('\n', ',').split(',') if v.strip()]


def edges(spacing):
    e = [0.0]
    for d in spacing:
        e.append(e[-1] + d)
    return e


def centers(e):
    return [(e[i] + e[i + 1]) / 2.0 for i in range(len(e) - 1)]


def norm(s):
    # strip special characters (°, ³, spaces...) so matching is encoding-independent
    return re.sub(r'[^a-z0-9]', '', s.lower())


def decode_text(raw):
    """EDX files are usually UTF-8; older ones ANSI. Also repairs mojibake like 'Â°C'."""
    for enc in ('utf-8', 'cp1252', 'latin-1'):
        try:
            txt = raw.decode(enc)
            break
        except (UnicodeDecodeError, LookupError):
            continue
    for bad, good in ((u'\u00c3\u201a\u00c2\u00b0', u'\u00b0'), (u'\u00c2\u00b0', u'\u00b0'),
                      (u'\u00c2\u00b2', u'\u00b2'), (u'\u00c2\u00b3', u'\u00b3'),
                      (u'\u00c2\u00b5', u'\u00b5')):
        txt = txt.replace(bad, good)
    return txt


def ascii_unit(u):
    for a, b in ((u'\u00b0C', 'degC'), (u'\u00b0', 'deg'), (u'\u00b2', '2'),
                 (u'\u00b3', '3'), (u'\u00b5', 'u')):
        u = u.replace(a, b)
    return u


def wrap(text, width):
    words, lines, cur = text.split(), [], ''
    for w in words:
        if cur and len(cur) + 1 + len(w) > width:
            lines.append(cur)
            cur = w
        else:
            cur = (cur + ' ' + w).strip()
    if cur:
        lines.append(cur)
    return lines or ['']


def parse_datetime(txt, path):
    """-> (date 'YYYY-MM-DD', hour int, time 'HH:MM'); None where not found"""
    d_raw, t_raw = tag(txt, 'simulation_date'), tag(txt, 'simulation_time')
    name = os.path.basename(path)
    if not d_raw:                                        # fallback: file name
        m = re.search(r'(\d{4})[-_.](\d{2})[-_.](\d{2})', name)
        d_raw = '%s-%s-%s' % m.groups() if m else None
    if not t_raw:
        m = re.search(r'\d{4}[-_.]\d{2}[-_.]\d{2}[_ ](\d{2})[.:]?(\d{2})(?:[.:](\d{2}))?', name)
        t_raw = ':'.join(g or '00' for g in m.groups()) if m else None
    date = None
    if d_raw:
        n = re.findall(r'\d+', d_raw)
        if len(n) >= 3:
            if len(n[0]) == 4:                           # YYYY-MM-DD
                y, mo, d = n[0], n[1], n[2]
            else:                                        # DD.MM.YYYY (ENVI-met default)
                d, mo, y = n[0], n[1], n[2]
            date = '%04d-%02d-%02d' % (int(y), int(mo), int(d))
    hour = time = None
    if t_raw:
        n = (re.findall(r'\d+', t_raw) + ['0', '0', '0'])[:3]
        h, mi = int(n[0]), int(n[1])
        hour, time = h, '%02d:%02d' % (h, mi)
    return date, hour, time


def build():
    # ---- 1. Read the EDX header
    with open(_edx, 'rb') as f:
        txt = decode_text(f.read())

    nx = int(tag(txt, 'nr_xdata'))
    ny = int(tag(txt, 'nr_ydata'))
    nz = int(tag(txt, 'nr_zdata'))
    xe = edges(floats(tag(txt, 'spacing_x')))
    ye = edges(floats(tag(txt, 'spacing_y')))
    ze = edges(floats(tag(txt, 'spacing_z')))
    var_names = [s.strip() for s in tag(txt, 'name_variables').split(',') if s.strip()]
    dims = (nx, ny, nz)
    x_levels, y_levels, z_levels = centers(xe), centers(ye), centers(ze)
    date, hour, time = parse_datetime(txt, _edx)
    datetime = ('%s %s' % (date or '', time or '')).strip() or None

    # ---- 2. Select variable, axis and index
    try:
        vi = int(_var)
    except (ValueError, TypeError):
        key = norm(_var)
        hits = [i for i, n in enumerate(var_names) if norm(n) == key]
        if not hits:
            hits = [i for i, n in enumerate(var_names) if key in norm(n)]
        if not hits:
            raise ValueError('Variable "%s" not found. See the var_names output.' % _var)
        vi = hits[0]

    axis = (_axis_ or 'z').strip().lower()
    k = int(_k) if _k is not None else 0
    limit = {'x': nx, 'y': ny, 'z': nz}[axis]
    if not 0 <= k < limit:
        raise ValueError('_k must be in the range 0..%d for axis %s' % (limit - 1, axis))

    # ---- 3. Read data from EDT (float32 LE, order: variable -> z -> y -> x)
    n2 = nx * ny
    edt = os.path.splitext(_edx)[0] + '.EDT'
    if not os.path.exists(edt):
        edt = os.path.splitext(_edx)[0] + '.edt'


    def read(offset, count):
        with open(edt, 'rb') as f:
            f.seek(offset * 4)
            buf = f.read(count * 4)
        a = array('f')
        try:
            a.frombytes(buf)
        except AttributeError:
            a.fromstring(buf)
        return a


    if axis == 'z':
        data = read((vi * nz + k) * n2, n2)   # read a single level only
        get = lambda i, j, kk: data[j * nx + i]
    else:
        data = read(vi * nz * n2, nz * n2)    # read the variable's full 3D block
        get = lambda i, j, kk: data[kk * n2 + j * nx + i]

    # ---- 4. Build the mesh
    o = _origin_ if _origin_ else rg.Point3d(0, 0, 0)
    mesh = rg.Mesh()
    values = []
    filled = []


    def quad(p0, p1, p2, p3, v):
        if v <= NODATA + 1:                       # empty cell (building / no data)
            if not _fill_:
                return
            v = _fill_value_
            filled.append(True)
        else:
            filled.append(False)
        a = mesh.Vertices.Count
        for p in (p0, p1, p2, p3):
            mesh.Vertices.Add(o.X + p[0], o.Y + p[1], o.Z + p[2])
        mesh.Faces.AddFace(a, a + 1, a + 2, a + 3)
        values.append(float(v))


    if axis == 'z':        # plan at level k
        z = z_levels[k]
        for j in range(ny):
            for i in range(nx):
                quad((xe[i], ye[j], z), (xe[i + 1], ye[j], z),
                     (xe[i + 1], ye[j + 1], z), (xe[i], ye[j + 1], z), get(i, j, k))

    elif axis == 'x':      # YZ section at column i = k
        x = x_levels[k]
        for kk in range(nz):
            for j in range(ny):
                quad((x, ye[j], ze[kk]), (x, ye[j + 1], ze[kk]),
                     (x, ye[j + 1], ze[kk + 1]), (x, ye[j], ze[kk + 1]), get(k, j, kk))

    else:                  # 'y' - XZ section at row j = k
        y = y_levels[k]
        for kk in range(nz):
            for i in range(nx):
                quad((xe[i], y, ze[kk]), (xe[i + 1], y, ze[kk]),
                     (xe[i + 1], y, ze[kk + 1]), (xe[i], y, ze[kk + 1]), get(i, k, kk))

    mesh.Normals.ComputeNormals()
    mesh.Compact()

    # ---- 5. Min / Max + legend title
    name = var_names[vi]
    um = re.search(r'\(([^()]*)\)\s*$', name)
    unit = um.group(1).strip() if um else ''
    if _ascii_unit_:
        unit = ascii_unit(unit)
    fmt = '%.' + str(_decimals_) + 'f'

    def with_unit(v):
        if v is None:
            return '-'
        return (fmt % v + (' ' + unit if unit else '')).strip()

    real = [v for v, f in zip(values, filled) if not f]   # ignore filled cells
    v_min = min(real) if real else None
    v_max = max(real) if real else None
    min_txt, max_txt = with_unit(v_min), with_unit(v_max)
    name_lines = wrap(name if not _ascii_unit_ else ascii_unit(name), _wrap_)
    body = [date or '-', time or '-', 'Min: ' + min_txt, 'Max: ' + max_txt]
    bar = '-' * max(len(l) for l in name_lines + body)   # same length for both bars
    legend_title = '\n'.join(name_lines + [bar] + body[:2] + [bar] + body[2:] + [' '])  # blank line below
    print('Variable #%d: %s | axis %s, index %d | %s' % (vi, var_names[vi], axis, k,
                                                          datetime or 'date/time not found'))
    return dict(var_names=var_names, dims=dims, x_levels=x_levels, y_levels=y_levels,
                z_levels=z_levels, mesh=mesh, values=values,
                date=date, hour=hour, time=time, datetime=datetime,
                v_min=v_min, v_max=v_max, unit=unit, min_txt=min_txt, max_txt=max_txt,
                legend_title=legend_title, filled=filled)

set_tooltips(TIPS_IN, TIPS_OUT,
             'Meerkat - reads an ENVI-met EDX/EDT output file and builds a section mesh + values')
if _run:
    result = build()
else:
    print('_run is False - nothing read, outputs empty')
    result = dict((n, None) for n in OUTS)

var_names, dims = result['var_names'], result['dims']
x_levels, y_levels, z_levels = result['x_levels'], result['y_levels'], result['z_levels']
mesh, values = result['mesh'], result['values']
date, hour, time, datetime = result['date'], result['hour'], result['time'], result['datetime']
v_min, v_max, unit = result['v_min'], result['v_max'], result['unit']
min_txt, max_txt, legend_title = result['min_txt'], result['max_txt'], result['legend_title']
filled = result['filled']
# ---------- end edx_reader ----------
wind_3d = Python3Script()  # -> out, x_levels, y_levels, z_levels, mesh, values, curves, points, vectors; inputs edx: String, mode: String, step: Int32, zstep: Int32, zmax: Double, max_arrows: Int32, scale: Double, vmax: Double, seeds: list of Point3d, seed_step: Int32, seed_z: Double, max_len: Double, tubes: Boolean, plane: String, k: Int32, origin: Point3d, run: Boolean
# ---------- wind_3d: Python ----------
"""ENVI-met EDX/EDT -> 3D wind (3D arrows or streamlines) for Grasshopper / Ladybug
Runs in GhPython (IronPython 2.7, Rhino 7) and Python 3 (Rhino 8).
Reads "Flow u", "Flow v", "Flow w" (m/s) from atmosphere output.

Performance notes (v2):
  - EDT data is cached between runs (re-read only when the file changes), so tweaking
    parameters is fast after the first run.
  - Interpolation uses plain floats + direct index lookup on uniform X/Y grids.
  - RK2 integration reuses the end-point velocity (2 lookups per step instead of 3).
  - Meshes are built in one batch; arrow/seed counts are capped.

Inputs (only _edx is required; the others can be left off the component):
    _run        : bool         - True = read the file and build; False = do nothing (file not
                                 read, all outputs empty). Boolean Toggle; default True
    _edx        : str          - path to the .EDX file (.EDT with same name, same folder)
    _mode_      : str          - "arrows" (default) or "streamlines"
    _step_      : int          - arrows: sample every n cells in X/Y (default 4)
    _zstep_     : int          - arrows: sample every n levels in Z (default 2)
    _zmax_      : float        - arrows: only draw below this height in m (default 20)
    _max_arrows_: int          - arrows: hard cap on arrow count (default 6000)
    _scale_     : float        - arrow / tube size factor (default 1.0)
    _vmax_      : float        - reference speed (m/s); fix it when comparing scenarios
    _seeds_     : list Point3d - streamline start points (Type hint Point3d, LIST ACCESS)
                                 empty = seed grid at height _seed_z_
    _seed_step_ : int          - default seed grid spacing in cells (default 8)
    _seed_z_    : float        - default seed grid height (m), default 1.5
    _max_len_   : float        - max length of each streamline (m), default 200
    _tubes_     : bool         - streamlines: build coloured tube mesh (default True);
                                 False = curves only (fastest)
    _plane_     : str          - streamlines on a 2D slice instead of full 3D:
                                 "z" = plan at level _k (uses u, v)
                                 "x" = vertical YZ section at column _k (uses v, w)
                                 "y" = vertical XZ section at row _k (uses u, w)
                                 empty = full 3D (default)
    _k          : int          - slice index for _plane_ (see x/y/z_levels), default 0
    _origin_    : Point3d      - model origin in Rhino
Outputs:
    x_levels, y_levels, z_levels : cell-centre coordinates (m) - use to pick _k
    mesh      : 3D arrow mesh or streamline tubes -> _mesh of LB Spatial Heatmap
    values    : wind speed per face               -> _values of LB Spatial Heatmap
    curves    : streamline polylines (streamlines mode)
    points, vectors : 3D wind points and vectors (arrows mode) for Vector Display
"""
import re
import os
import math
import time
import bisect
from array import array
import Rhino.Geometry as rg
import scriptcontext as sc
from System.Collections.Generic import List

t0 = time.time()
NODATA = -999.0


TIPS_IN = {
    '_run': 'bool - True = read the file and build; False = do nothing\n'
            '(file not read, all outputs empty). Connect a Boolean Toggle. Default True.',
    '_edx': 'str - full path to the ENVI-met ATMOSPHERE .EDX file (Flow u / v / w).\n'
            'The .EDT file must have the same name and folder. Data is cached until the file changes.',
    '_mode_': 'str (optional) - "arrows" = 3D arrows on a sampled grid (default)\n'
              '"streamlines" = traced flow lines (full 3D or on a slice, see _plane_).',
    '_step_': 'int (optional) - arrows: sample every n-th cell in X / Y. Default 4.',
    '_zstep_': 'int (optional) - arrows: sample every n-th level in Z. Default 2.',
    '_zmax_': 'float (optional) - arrows: only draw arrows below this height (m). Default 20.',
    '_max_arrows_': 'int (optional) - arrows: hard cap on the number of arrows;\n'
                    'samples are thinned evenly above it. Default 6000.',
    '_scale_': 'float (optional) - size multiplier for arrows / tubes. Default 1.0.',
    '_vmax_': 'float (optional) - arrows: reference speed (m/s); an arrow of this speed is\n'
              '~0.9 x sample spacing long (capped at 1.5x). Fix it when comparing scenarios;\n'
              'empty = maximum of the sampled cells.',
    '_seeds_': 'list Point3d (optional, LIST ACCESS) - streamline start points (Rhino coordinates).\n'
               'With _plane_ set they are projected onto the slice.\n'
               'Empty = seed grid every _seed_step_ cells at height _seed_z_.',
    '_seed_step_': 'int (optional) - spacing of the default seed grid in cells. Default 8.\n'
                   'On x / y slices the vertical seed spacing is _seed_step_ / 4 levels.',
    '_seed_z_': 'float (optional) - height (m) of the default 3D seed grid. Default 1.5.',
    '_max_len_': 'float (optional) - max length of each streamline (m). Default 200.\n'
                 'Lines also stop at buildings, the domain edge or below 0.05 m/s.',
    '_tubes_': 'bool (optional) - streamlines: True = build a coloured tube mesh (default);\n'
               'False = curves only (fastest).',
    '_plane_': 'str (optional) - streamlines on a 2D slice instead of full 3D:\n'
               '"z" = plan at level _k (u, v)\n"x" = vertical YZ section at column _k (v, w)\n'
               '"y" = vertical XZ section at row _k (u, w)\nempty = full 3D (default).',
    '_k': 'int (optional) - slice index for _plane_ (see x_levels / y_levels / z_levels). Default 0.',
    '_origin_': 'Point3d (optional) - position of the ENVI-met model origin in Rhino. Default (0,0,0).',
}
TIPS_OUT = {
    'x_levels': 'Cell-centre x coordinates (m) - pick _k for _plane_ = "x".',
    'y_levels': 'Cell-centre y coordinates (m) - pick _k for _plane_ = "y".',
    'z_levels': 'Cell-centre heights (m) - pick _k for _plane_ = "z".',
    'mesh': '3D arrow mesh (arrows) or streamline tubes (streamlines)\n'
            '-> _mesh of the Heatmap / LB Spatial Heatmap.',
    'values': 'Wind speed (m/s) per mesh face -> _values of the Heatmap / LB Spatial Heatmap (List Access).',
    'curves': 'streamlines mode: one polyline per streamline (Rhino coordinates).',
    'points': 'arrows mode: position of every sampled cell (incl. calm cells without an arrow).',
    'vectors': 'arrows mode: 3D wind vector (u, v, w) in m/s at each point -> Vector Display.',
}


def set_tooltips(tips_in, tips_out, comp_desc=None):
    """write the tooltip (Description) of every input / output of this component.
    Matched by NickName; only changed when different, so it costs nothing after the first run"""
    try:
        comp = ghenv.Component  # noqa: F821
    except NameError:
        return
    try:
        if comp_desc and comp.Description != comp_desc:
            comp.Description = comp_desc
        for plist, tips in ((comp.Params.Input, tips_in), (comp.Params.Output, tips_out)):
            for p in plist:
                t = tips.get(p.NickName) or tips.get(p.Name)
                if t and p.Description != t:
                    p.Description = t
    except Exception as ex:                              # tooltips must never break the solve
        print('tooltips not set: %s' % ex)


set_tooltips(TIPS_IN, TIPS_OUT,
             'Meerkat - 3D wind from ENVI-met: 3D arrows or streamlines (full 3D or on a slice)')


def opt(name, default=None):
    v = globals().get(name, default)
    return default if v is None or v == [] else v


run = bool(opt('_run', True))
mode = str(opt('_mode_', 'arrows')).strip().lower()
step = max(1, int(opt('_step_', 4)))
zstep = max(1, int(opt('_zstep_', 2)))
zmax = float(opt('_zmax_', 20.0))
max_arrows = int(opt('_max_arrows_', 6000))
scale = float(opt('_scale_', 1.0))
vmax_in = opt('_vmax_', None)
seeds_in = opt('_seeds_', None)
seed_step = max(1, int(opt('_seed_step_', 8)))
seed_z = float(opt('_seed_z_', 1.5))
max_len = float(opt('_max_len_', 200.0))
tubes = bool(opt('_tubes_', True))
o = opt('_origin_', rg.Point3d(0, 0, 0))
plane = str(opt('_plane_', '')).strip().lower()
plane = plane if plane in ('x', 'y', 'z') else None
kidx = int(opt('_k', 0))
if seeds_in is not None and not isinstance(seeds_in, (list, tuple)):
    seeds_in = [seeds_in]
ox, oy, oz = o.X, o.Y, o.Z


# =============== 1. LOAD DATA (cached) ===============
def tag(txt, name):
    m = re.search(r'<%s>(.*?)</%s>' % (name, name), txt, re.S | re.I)
    return m.group(1).strip() if m else None


def floats(s):
    return [float(v) for v in s.replace('\n', ',').split(',') if v.strip()]


def centers(sp):
    c, e = [], 0.0
    for d in sp:
        c.append(e + d / 2.0)
        e += d
    return c


def norm(s):
    return re.sub(r'[^a-z0-9]', '', s.lower())


def read(path, offset, count):
    with open(path, 'rb') as f:
        f.seek(offset * 4)
        buf = f.read(count * 4)
    a = array('f')
    try:
        a.frombytes(buf)
    except AttributeError:
        a.fromstring(buf)
    return a


def load(edx):
    with open(edx, 'rb') as f:
        txt = f.read().decode('latin-1')
    d = {}
    d['nx'], d['ny'], d['nz'] = [int(tag(txt, t)) for t in ('nr_xdata', 'nr_ydata', 'nr_zdata')]
    d['dxs'], d['dys'], d['dzs'] = [floats(tag(txt, t)) for t in ('spacing_x', 'spacing_y', 'spacing_z')]
    names = [s.strip() for s in tag(txt, 'name_variables').split(',') if s.strip()]

    def find(prefix):
        for i, n in enumerate(names):
            if norm(n).startswith(prefix):
                return i
        raise ValueError('Variable "%s" not found. Is this an atmosphere output?' % prefix)

    n3 = d['nx'] * d['ny'] * d['nz']
    edt = os.path.splitext(edx)[0] + '.EDT'
    if not os.path.exists(edt):
        edt = os.path.splitext(edx)[0] + '.edt'
    U = read(edt, find('flowu') * n3, n3)
    V = read(edt, find('flowv') * n3, n3)
    W = read(edt, find('floww') * n3, n3)
    S = bytearray(n3)                                   # 1 = building / no-data
    lim = NODATA + 1
    for q in range(n3):
        if U[q] <= lim or V[q] <= lim or W[q] <= lim:
            S[q] = 1
    d['U'], d['V'], d['W'], d['S'] = U, V, W, S
    return d


def build():
    edt_path = os.path.splitext(_edx)[0] + '.EDT'
    if not os.path.exists(edt_path):
        edt_path = os.path.splitext(_edx)[0] + '.edt'
    key = (_edx, os.path.getmtime(_edx), os.path.getmtime(edt_path))
    cache = sc.sticky.get('envimet_wind3d_cache')
    if not cache or cache.get('key') != key:
        cache = load(_edx)
        cache['key'] = key
        sc.sticky['envimet_wind3d_cache'] = cache

    nx, ny, nz = cache['nx'], cache['ny'], cache['nz']
    dxs, dys, dzs = cache['dxs'], cache['dys'], cache['dzs']
    U, V, W, S = cache['U'], cache['V'], cache['W'], cache['S']
    xc, yc, zc = centers(dxs), centers(dys), centers(dzs)
    x_levels, y_levels, z_levels = xc, yc, zc
    n2 = nx * ny
    t_load = time.time() - t0


    # =============== 2. FAST TRILINEAR INTERPOLATION ===============
    def make_locator(cs, sp):
        n = len(cs)
        c0, c1 = cs[0], cs[-1]
        if max(sp) - min(sp) < 1e-6:                        # uniform grid: direct index
            inv = 1.0 / sp[0]

            def loc(x):
                f = (x - c0) * inv
                if f < 0.0 or f > n - 1:
                    return -1, 0.0
                i = int(f)
                if i >= n - 1:
                    i = n - 2
                return i, f - i
        else:                                               # non-uniform: bisect
            def loc(x):
                if x < c0 or x > c1:
                    return -1, 0.0
                i = bisect.bisect_right(cs, x) - 1
                if i >= n - 1:
                    i = n - 2
                if i < 0:
                    i = 0
                return i, (x - cs[i]) / (cs[i + 1] - cs[i])
        return loc


    locx, locy, locz = make_locator(xc, dxs), make_locator(yc, dys), make_locator(zc, dzs)
    z_floor = zc[0]


    def velocity(x, y, z):
        """model coordinates -> (u, v, w) or None if outside domain / inside a building"""
        if z < z_floor:
            z = z_floor
        i, tx = locx(x)
        if i < 0:
            return None
        j, ty = locy(y)
        if j < 0:
            return None
        k, tz = locz(z)
        if k < 0:
            return None
        b = k * n2 + j * nx + i
        sx, sy, sz = 1.0 - tx, 1.0 - ty, 1.0 - tz
        corners = ((b, sx * sy * sz), (b + 1, tx * sy * sz),
                   (b + nx, sx * ty * sz), (b + nx + 1, tx * ty * sz),
                   (b + n2, sx * sy * tz), (b + n2 + 1, tx * sy * tz),
                   (b + n2 + nx, sx * ty * tz), (b + n2 + nx + 1, tx * ty * tz))
        u = v = w = 0.0
        for q, wt in corners:
            if wt > 0.0:
                if S[q]:
                    return None
                u += wt * U[q]
                v += wt * V[q]
                w += wt * W[q]
        return u, v, w


    # =============== 3. BATCH MESH BUILDER ===============
    verts = List[rg.Point3d]()
    faces = List[rg.MeshFace]()
    values = []


    def frame(dx, dy, dz):
        if abs(dz) < 0.9:                                   # e1 = d x Z
            e1 = (dy, -dx, 0.0)
        else:                                               # e1 = d x X
            e1 = (0.0, dz, -dy)
        l = math.sqrt(e1[0] ** 2 + e1[1] ** 2 + e1[2] ** 2)
        e1 = (e1[0] / l, e1[1] / l, e1[2] / l)
        e2 = (dy * e1[2] - dz * e1[1], dz * e1[0] - dx * e1[2], dx * e1[1] - dy * e1[0])
        return e1, e2


    def add_ring(cx, cy, cz, e1, e2, r, n):
        for s in range(n):
            a = 2.0 * math.pi * s / n
            ca, sa = r * math.cos(a), r * math.sin(a)
            verts.Add(rg.Point3d(cx + e1[0] * ca + e2[0] * sa,
                                 cy + e1[1] * ca + e2[1] * sa,
                                 cz + e1[2] * ca + e2[2] * sa))


    def add_arrow3d(c, d, L, r, spd, n=4):
        e1, e2 = frame(*d)
        hl = min(0.4 * L, 4.0 * r)
        tail = (c[0] - d[0] * L / 2, c[1] - d[1] * L / 2, c[2] - d[2] * L / 2)
        tip = (c[0] + d[0] * L / 2, c[1] + d[1] * L / 2, c[2] + d[2] * L / 2)
        neck = (tip[0] - d[0] * hl, tip[1] - d[1] * hl, tip[2] - d[2] * hl)
        a = verts.Count
        add_ring(tail[0], tail[1], tail[2], e1, e2, r, n)
        add_ring(neck[0], neck[1], neck[2], e1, e2, r, n)
        add_ring(neck[0], neck[1], neck[2], e1, e2, 2.5 * r, n)
        verts.Add(rg.Point3d(*tip))
        t = a + 3 * n
        for s in range(n):
            s1 = (s + 1) % n
            faces.Add(rg.MeshFace(a + s, a + s1, a + n + s1, a + n + s))
            faces.Add(rg.MeshFace(a + n + s, a + n + s1, a + 2 * n + s1, a + 2 * n + s))
            faces.Add(rg.MeshFace(a + 2 * n + s, a + 2 * n + s1, t))
        values.extend([spd] * (3 * n))


    def add_tube(pts, spds, r, n=3):
        for m in range(len(pts) - 1):
            p0, p1 = pts[m], pts[m + 1]
            dx, dy, dz = p1[0] - p0[0], p1[1] - p0[1], p1[2] - p0[2]
            l = math.sqrt(dx * dx + dy * dy + dz * dz)
            if l < 1e-9:
                continue
            e1, e2 = frame(dx / l, dy / l, dz / l)
            a = verts.Count
            add_ring(p0[0], p0[1], p0[2], e1, e2, r, n)
            add_ring(p1[0], p1[1], p1[2], e1, e2, r, n)
            for s in range(n):
                s1 = (s + 1) % n
                faces.Add(rg.MeshFace(a + s, a + s1, a + n + s1, a + n + s))
            values.extend([(spds[m] + spds[m + 1]) / 2.0] * n)


    points, vectors, curves = [], [], []
    cell = min(min(dxs), min(dys))

    # =============== 4a. MODE: 3D ARROWS ===============
    if mode.startswith('arrow'):
        samples = []
        for k in range(0, nz, zstep):
            if zc[k] > zmax:
                break
            for j in range(0, ny, step):
                row = k * n2 + j * nx
                for i in range(0, nx, step):
                    q = row + i
                    if S[q]:
                        continue
                    samples.append((xc[i], yc[j], zc[k], U[q], V[q], W[q]))
        if not samples:
            raise ValueError('No valid cells.')
        if len(samples) > max_arrows:                       # thin out evenly
            m = int(math.ceil(len(samples) / float(max_arrows)))
            samples = samples[::m]
        spd_all = [math.sqrt(u * u + v * v + w * w) for _, _, _, u, v, w in samples]
        vmax = float(vmax_in) if vmax_in else max(spd_all)
        vmax = vmax if vmax > 1e-9 else 1.0
        base = cell * step
        r = 0.05 * base * scale
        for (x, y, z, u, v, w), spd in zip(samples, spd_all):
            c = (x + ox, y + oy, z + oz)
            points.append(rg.Point3d(*c))
            vectors.append(rg.Vector3d(u, v, w))
            if spd < 1e-6:
                continue
            L = 0.9 * base * scale * min(spd / vmax, 1.5)
            add_arrow3d(c, (u / spd, v / spd, w / spd), L, r, spd)

    # =============== 4b. MODE: STREAMLINES ===============
    else:
        if plane is None:                                   # ---- full 3D ----
            vfun = velocity
            if seeds_in:
                seeds = [(p.X - ox, p.Y - oy, p.Z - oz) for p in seeds_in]
            else:
                seeds = [(xc[i], yc[j], seed_z)
                         for j in range(0, ny, seed_step) for i in range(0, nx, seed_step)]
        else:                                               # ---- 2D slice ----
            limit = {'x': nx, 'y': ny, 'z': nz}[plane]
            if not 0 <= kidx < limit:
                raise ValueError('_k must be in range 0..%d for _plane_ %s' % (limit - 1, plane))
            zs = max(1, seed_step // 4)                     # vertical seed spacing (levels)
            if plane == 'z':
                zf = zc[kidx]

                def vfun(x, y, z):
                    r = velocity(x, y, zf)
                    return None if r is None else (r[0], r[1], 0.0)
                fix = lambda p: (p[0], p[1], zf)
                grid = [(xc[i], yc[j], zf)
                        for j in range(0, ny, seed_step) for i in range(0, nx, seed_step)]
            elif plane == 'x':
                xf = xc[kidx]

                def vfun(x, y, z):
                    r = velocity(xf, y, z)
                    return None if r is None else (0.0, r[1], r[2])
                fix = lambda p: (xf, p[1], p[2])
                grid = [(xf, yc[j], zc[kk])
                        for kk in range(0, nz, zs) for j in range(0, ny, seed_step)]
            else:
                yf = yc[kidx]

                def vfun(x, y, z):
                    r = velocity(x, yf, z)
                    return None if r is None else (r[0], 0.0, r[2])
                fix = lambda p: (p[0], yf, p[2])
                grid = [(xc[i], yf, zc[kk])
                        for kk in range(0, nz, zs) for i in range(0, nx, seed_step)]
            if seeds_in:                                    # project user seeds onto the slice
                seeds = [fix((p.X - ox, p.Y - oy, p.Z - oz)) for p in seeds_in]
            else:
                seeds = grid
        ds = 0.75 * cell                                    # integration step (m)
        nmax = int(max_len / ds)
        vmin = 0.05
        r_tube = 0.08 * cell * scale
        dec = 3                                             # keep every 3rd point for tubes
        for (x, y, z) in seeds:
            vel = vfun(x, y, z)
            if vel is None:
                continue
            pts, spds = [(x, y, z)], [math.sqrt(vel[0] ** 2 + vel[1] ** 2 + vel[2] ** 2)]
            for _ in range(nmax):                           # arc-length RK2
                s = spds[-1]
                if s < vmin:
                    break
                h = 0.5 * ds / s
                vm = vfun(x + vel[0] * h, y + vel[1] * h, z + vel[2] * h)
                if vm is None:
                    break
                sm = math.sqrt(vm[0] ** 2 + vm[1] ** 2 + vm[2] ** 2)
                if sm < vmin:
                    break
                h = ds / sm
                x, y, z = x + vm[0] * h, y + vm[1] * h, z + vm[2] * h
                vel = vfun(x, y, z)
                if vel is None:
                    break
                pts.append((x, y, z))
                spds.append(math.sqrt(vel[0] ** 2 + vel[1] ** 2 + vel[2] ** 2))
            if len(pts) < 3:
                continue
            pts = [(p[0] + ox, p[1] + oy, p[2] + oz) for p in pts]
            pl = List[rg.Point3d]()
            for p in pts:
                pl.Add(rg.Point3d(*p))
            curves.append(rg.PolylineCurve(pl))
            if tubes:
                keep = list(range(0, len(pts), dec))
                if keep[-1] != len(pts) - 1:
                    keep.append(len(pts) - 1)
                add_tube([pts[i] for i in keep], [spds[i] for i in keep], r_tube)

    mesh = rg.Mesh()
    mesh.Vertices.AddVertices(verts)
    mesh.Faces.AddFaces(faces)
    mesh.Normals.ComputeNormals()
    print('%s%s | %d faces | %d streamlines | load %.1fs | total %.1fs'
          % (mode, (' on %s-slice %d' % (plane, kidx)) if plane and not mode.startswith('arrow') else '', mesh.Faces.Count, len(curves), t_load, time.time() - t0))
    return dict(x_levels=x_levels, y_levels=y_levels, z_levels=z_levels, mesh=mesh,
                values=values, curves=curves, points=points, vectors=vectors)


OUTS = ('x_levels', 'y_levels', 'z_levels', 'mesh', 'values', 'curves', 'points', 'vectors')
if run:
    result = build()
else:
    print('_run is False - nothing read, outputs empty')
    result = dict((n, None) for n in OUTS)
x_levels, y_levels, z_levels = result['x_levels'], result['y_levels'], result['z_levels']
mesh, values, curves = result['mesh'], result['values'], result['curves']
points, vectors = result['points'], result['vectors']
# ---------- end wind_3d ----------
heatmap = Python3Script()  # -> out, mesh, legend, tag_pts, tag_txt, text_size, title_pts, title_txt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; inputs run: Boolean, mode: String, smooth: Int32, levels: Int32, filled: list of Boolean, mesh: Mesh, values: list of Double, vmin: Double, vmax: Double, colors: list of Color, legend_title: String, global_title: String, title_xz: Boolean, title_pt: Point3d, title_scale: Double, legend_pt: Point3d, legend_scale: Double, range_labels: Boolean, legend_n: Int32, decimals: Int32, label_spacing: Double, label_size: Double, label_min_len: Double, peaks: Boolean, peak_value: String, peak_min_cells: Int32, peak_pos: String, peak_fit: Boolean, label_horizontal: Boolean
#   port mode: str - display mode: "cells" = one flat colour per cell (default) "smooth" = colours interpolated between cells "contour" = filled colour bands + isolines
# ---------- heatmap: Python ----------
"""Fast heatmap / contour map for ENVI-met data (replaces LB Spatial Heatmap)
Runs in GhPython (IronPython 2.7, Rhino 7) and Python 3 (Rhino 8).

Colours the mesh from envimet_edx_reader.py and builds a legend. Much faster than
LB Spatial Heatmap: geometry and colours are passed to Rhino in a few bulk calls instead
of being converted to Ladybug geometry and rebuilt vertex by vertex.

Performance notes (v2):
    - .NET arrays are copied to Python lists once (per-element .NET access is very slow
      in Rhino 8 / CPython), colours are sent to Rhino in a single SetColors call
    - per-vertex band / clamped value are computed once instead of once per face
    - faces lying in one colour band (usually most) are coloured with native
      Duplicate/DeleteFaces/Unweld; only band-crossing faces are clipped in Python
    - new geometry is handed to Rhino as one block memory copy (Point3d[] / MeshFace[])
    - isolines are chained through shared mesh edges (exact, pure Python) instead of
      thousands of LineCurves + Curve.JoinCurves
    - mesh / contour geometry is cached: changing only legend inputs does not recompute it
    - smooth / contour weld the (unwelded) reader mesh first, so neighbouring cells share
      vertices -> real gradients and isolines

Display modes (_mode_):
    "cells"   - one flat colour per ENVI-met cell (default, same look as LB Spatial Heatmap)
    "smooth"  - colours interpolated between cells (continuous gradient)
    "contour" - contour map: filled colour bands between _levels_ equal steps + isolines

Inputs (only _mesh and _values are required):
    _run          : bool        - False = do nothing, all outputs empty (default True)
    _mesh         : Mesh        - mesh output of envimet_edx_reader.py
    _values       : list float  - values output of envimet_edx_reader.py (LIST ACCESS),
                                  one value per mesh face
    _filled_      : list bool   - filled output of the reader (LIST ACCESS, optional). Filled
                                  cells (buildings) are left out of the smoothing / contours
                                  and keep their flat colour
    _mode_        : str         - "cells" (default), "smooth" or "contour"
    _levels_      : int         - contour: number of colour bands (default 10)
    _smooth_      : int         - smooth / contour: smoothing passes on the vertex values
                                  (0 = none, default). Each pass averages every vertex with its
                                  neighbours (buildings excluded): smoother isolines, fewer noise
                                  islands. 1-3 light, 5-10 strong. Peaks get slightly flattened
    _vmin_, _vmax_: float       - colour range; connect v_min / v_max of the reader.
                                  Default: min / max of _values
    _colors_      : list Colour - custom gradient (LIST ACCESS); default = Ladybug palette
    _legend_title_: str         - legend_title output of the reader (multi-line text)
    _legend_pt_   : Point3d     - base point of the legend (default: right of the mesh)
    _legend_scale_: float       - size multiplier for legend bar + text (default 1.0)
    _legend_n_    : int         - number of value labels (cells / smooth; default 6).
                                  In contour mode every band boundary is labelled
    _decimals_    : int         - decimals of the legend labels (default 1)
    _global_title_: str         - main title of the map (multi-line ok), placed under the mesh
    _title_pt_    : Point3d     - top-left point of the global title (default: under the mesh,
                                  aligned with its left edge)
    _title_scale_ : float       - size multiplier of the global title (default 1.0)
    _title_xz_    : bool        - True = legend (bar, value labels, legend title) and global title
                                  stand upright in the vertical XZ plane (for sections / 3D views).
                                  tag_pts and title_pts then become PLANES. Default False
    _range_labels_: bool        - True = each label shows a value RANGE ("30.25 - 30.50") at the
                                  middle of its band instead of single tick values (default False).
                                  Contour: one range per band; cells / smooth: _legend_n_ - 1
                                  ranges. Values outside _vmin_/_vmax_ give "< x" / ">= x" ends
    _label_spacing_: float      - contour: distance between value labels along an isoline
                                  (default 0.15 x site diagonal)
    _label_size_  : float       - contour: text height of the isoline labels (default 1.2 % of
                                  the site diagonal)
    _label_min_len_: float      - contour: isolines shorter than this get no label
                                  (default 0.3 x _label_spacing_)
    _label_horizontal_: bool    - contour: True = isoline labels written horizontally (centred on
                                  the line) instead of following the line. Default False
    _peaks_       : bool        - contour: label every closed innermost contour (local peak /
                                  hot spot) with the HIGHEST data value of that zone, placed at
                                  the centre of the zone. Default True
    _peak_value_  : str         - contour: which value the peak label shows
                                  "max"    = highest cell value inside the zone (default)
                                  "centre" = data of the cell at the centre of the zone
    _peak_min_cells_: int       - contour: smallest zone (in cells) for a peak label. If the
                                  innermost contour of a hill is smaller, the next contour out
                                  is used (the label still shows the hill's maximum)
                                  (default 10). Peak labels keep the same minimum distance
                                  as the isoline labels; higher peaks win
    _peak_pos_    : str         - contour: where the peak label goes
                                  "centre" = centre cell of the contour (default)
                                  "max"    = centred on the cell with the maximum value
                                  "above"  = just above the maximum cell (peak_pts marks it)
    _peak_fit_    : bool        - contour: True = drop a peak label whose text does not fit
                                  inside its contour (default False). Peak regions are often only a
                                  few cells wide: use a small _label_size_ with this option.
                                  One-cell-wide strips are never labelled (not a real centre)
Outputs:
    mesh       : coloured mesh
    contours   : contour mode: isolines (joined curves) at the band boundaries
    contour_val: value of each isoline
    legend     : coloured legend bar mesh (stepped in contour mode)
    tag_pts    : positions of all legend texts (value labels + title)   } -> Text Tag 3D
                 (planes in the XZ plane when _title_xz_ is True)
    tag_txt    : the legend texts                                       }
                 (the title is split into one tag per line, stacked from the bottom up,
                  so the last line always sits just above the bar)
    text_size  : suggested text height -> Size input of Text Tag 3D
    title_pts  : positions of the global title lines (top-down)        } -> 2nd Text Tag 3D
                 (planes in the XZ plane when _title_xz_ is True)
    title_txt  : global title, one item per line                        }
    title_size : text height for the global title
    v_range    : (vmin, vmax) used
    iso_planes : contour: one plane per isoline label (along the line, readable) } -> 3rd
    iso_txt    : contour: label text (isoline value)                            }  Text Tag 3D
    iso_size   : contour: text height of the isoline labels                     }
    iso_val    : contour: value of each label
    peak_planes: contour: one plane per peak label (see _peak_pos_)     } -> 4th Text Tag 3D
    peak_txt   : contour: value shown for each peak (see _peak_value_)  }
    peak_val   : contour: that value (number)
    peak_pts   : contour: centre of the cell the value was taken from
"""
import time
import Rhino.Geometry as rg
import System
import System.Drawing as sd
from System.Runtime.InteropServices import GCHandle, GCHandleType, Marshal

try:
    import scriptcontext as sc
except ImportError:
    sc = None

LB_COLORS = [(75, 107, 169), (115, 147, 202), (170, 200, 247), (193, 213, 208),
             (245, 239, 103), (252, 230, 74), (239, 156, 21), (234, 123, 0),
             (234, 74, 0), (234, 38, 0)]
TIPS_IN = {
    '_run': 'bool - False = do nothing, all outputs empty. Default True.',
    '_mesh': 'Mesh - mesh output of the ENVI-met reader (one face per cell).',
    '_values': 'list float - values output of the reader, one value per mesh face.\nSet this input to LIST ACCESS.',
    '_filled_': 'list bool (optional) - filled output of the reader (LIST ACCESS).\nFilled cells (buildings) keep a flat colour and are left out of smoothing / contours.',
    '_mode_': 'str - display mode:\n"cells" = one flat colour per cell (default)\n"smooth" = colours interpolated between cells\n"contour" = filled colour bands + isolines',
    '_levels_': 'int - contour mode: number of equal colour bands between _vmin_ and _vmax_. Default 10.',
    '_smooth_': 'int - smooth / contour: smoothing passes on the vertex values (0 = none, default).\nSmoother isolines, fewer noise islands. 1-3 light, 5-10 strong.\nPeaks get slightly flattened - use 0 when exact values matter.',
    '_vmin_': 'float (optional) - lower end of the colour range. Connect v_min of the reader.\nDefault: minimum of _values.',
    '_vmax_': 'float (optional) - upper end of the colour range. Connect v_max of the reader.\nDefault: maximum of _values.',
    '_colors_': 'list Colour (optional, LIST ACCESS) - custom gradient from low to high.\nDefault: Ladybug palette.',
    '_legend_title_': 'str (optional) - legend title, multi-line. Connect legend_title of the reader.\nLines are stacked bottom-up above the legend bar.',
    '_legend_pt_': 'Point3d (optional) - base point (bottom-left) of the legend. Default: right of the mesh.',
    '_legend_scale_': 'float (optional) - size multiplier for legend bar + texts. Default 1.0.',
    '_legend_n_': 'int (optional) - cells / smooth: number of value labels. Default 6.\nIn contour mode every band boundary is labelled.',
    '_decimals_': 'int (optional) - decimals of the legend labels. Default 1.',
    '_range_labels_': 'bool (optional) - True = labels show value RANGES ("30.25 - 30.50") at the middle\nof each band instead of single tick values; values outside the range give "< x" / ">= x". Default False.',
    '_global_title_': 'str (optional) - main title of the map (multi-line ok), placed under the mesh.',
    '_title_pt_': 'Point3d (optional) - top-left point of the global title. Default: under the mesh, left aligned.',
    '_title_scale_': 'float (optional) - size multiplier of the global title. Default 1.0.',
    '_title_xz_': 'bool (optional) - True = the legend (bar, value labels, legend title) and the global\n'
                  'title stand upright in the vertical XZ plane (text faces -Y, reads along +X, up = +Z),\n'
                  'e.g. for XZ sections or 3D views. tag_pts / title_pts then output PLANES - connect\n'
                  'them to the Location of Text Tag 3D as before. Default False (flat in XY).',
    '_label_spacing_': 'float (optional) - contour: distance between value labels along an isoline\n'
                       '(model units). Long lines get several labels. Default 0.15 x site diagonal.\n'
                       'Labels of different lines keep at least 0.35 x this distance apart.',
    '_label_size_': 'float (optional) - contour: text height of the isoline labels.\n'
                    'Default 1.2 % of the site diagonal.',
    '_label_min_len_': 'float (optional) - contour: isolines shorter than this get no label\n'
                       '(hides labels on small noise islands). Default 0.3 x _label_spacing_.',
    '_label_horizontal_': 'bool (optional) - contour: True = isoline labels are written horizontally\n'
                          '(centred on the line) instead of following the line direction. Default False.\n'
                          'Use this instead of converting iso_planes with an XY Plane component.',
    '_peaks_': 'bool (optional) - contour: label every closed innermost contour (local peak /\n'
               'hot spot) with the HIGHEST real cell value of that zone, placed at the centre of\n'
               'the zone (see _peak_value_ / _peak_pos_). Zones touching the outer edge of the\n'
               'site are skipped; zones next to buildings are kept. Default True.',
    '_peak_value_': 'str (optional) - contour: which value the peak label shows:\n'
                    '"max" = highest cell value inside the zone (default)\n'
                    '"centre" = data of the cell at the centre of the zone',
    '_peak_min_cells_': 'int (optional) - contour: smallest zone (number of cells) for a peak label.\n'
                        'If the innermost contour of a hill is smaller (or only one cell wide), the\n'
                        'next contour out is used; the label still shows the hill maximum. Default 10.\n'
                        'Peak labels keep the isoline-label distance from each other; higher peaks win.',
    '_peak_pos_': 'str (optional) - contour: where the peak label goes:\n'
                  '"centre" = centre cell of the contour, farthest from its isoline (default)\n'
                  '"max" = centred on the cell with the maximum value\n'
                  '"above" = just above the maximum cell (show peak_pts as a dot to mark it)',
    '_peak_fit_': 'bool (optional) - contour: True = drop a peak label whose text does not fit inside\n'
                  'its contour, so labels never cross isolines (default False = keep all).\n'
                  'Peak regions are often only a few cells wide - use a small _label_size_ with it.\n'
                  'One-cell-wide strips never get a peak label (they have no real centre).',
}
TIPS_OUT = {
    'mesh': 'Coloured mesh (cells / smooth / contour bands).',
    'contours': 'contour mode: isolines (joined polylines) at the band boundaries; empty in other modes.',
    'contour_val': 'Value of each isoline (same order as contours).',
    'legend': 'Coloured legend bar mesh (stepped in contour mode).',
    'tag_pts': 'Positions of the legend texts (value labels + title lines) -> Location of Text Tag 3D.\n'
               'Points (flat XY) or planes (upright XZ, _title_xz_ = True).',
    'tag_txt': 'Legend texts -> Text of Text Tag 3D.',
    'text_size': 'Suggested text height for the legend -> Size of Text Tag 3D.',
    'v_range': '(vmin, vmax) actually used for the colours.',
    'title_pts': 'Positions of the global title lines -> Location of a 2nd Text Tag 3D.\n'
                 'Points (flat XY) or planes (upright XZ, _title_xz_ = True).',
    'title_txt': 'Global title, one item per line -> Text of the 2nd Text Tag 3D.',
    'title_size': 'Text height of the global title -> Size of the 2nd Text Tag 3D.',
    'iso_planes': 'contour: one plane per isoline label, aligned with the line and turned so the\n'
                  'text always reads left-to-right -> Location of a 3rd Text Tag 3D.\n'
                  'Connect the planes DIRECTLY (not through XY Plane): the origin is the text corner,\n'
                  'computed for this orientation. Labels whose text would leave the domain are dropped.',
    'iso_txt': 'contour: label texts (isoline values, _decimals_) -> Text of the 3rd Text Tag 3D.',
    'iso_size': 'contour: text height of the isoline labels -> Size of the 3rd Text Tag 3D.',
    'iso_val': 'contour: value of each label (same order as iso_planes).',
    'peak_planes': 'contour: one plane per peak label, placed as set by _peak_pos_\n'
                   '(kept inside the domain). Connect directly, not through XY Plane\n'
                   '-> Location of a 4th Text Tag 3D (style it differently from the isoline labels).',
    'peak_txt': 'contour: value of each peak label (centre cell or max, see _peak_value_)\n'
                '-> Text of the 4th Text Tag 3D.',
    'peak_val': 'contour: value of each peak label (number).',
    'peak_pts': 'contour: centre of the cell the peak value was taken from.',
}
def set_tooltips(tips_in, tips_out, comp_desc=None):
    """write the tooltip (Description) of every input / output of this component.
    Matched by NickName; only changed when different, so it costs nothing after the first run"""
    try:
        comp = ghenv.Component  # noqa: F821
    except NameError:
        return
    try:
        if comp_desc and comp.Description != comp_desc:
            comp.Description = comp_desc
        for plist, tips in ((comp.Params.Input, tips_in), (comp.Params.Output, tips_out)):
            for p in plist:
                t = tips.get(p.NickName) or tips.get(p.Name)
                if t and p.Description != t:
                    p.Description = t
    except Exception as ex:                              # tooltips must never break the solve
        print('tooltips not set: %s' % ex)


OUTS = ('mesh', 'contours', 'contour_val', 'legend', 'tag_pts', 'tag_txt', 'text_size',
        'v_range', 'title_pts', 'title_txt', 'title_size',
        'iso_planes', 'iso_txt', 'iso_size', 'iso_val',
        'peak_planes', 'peak_txt', 'peak_val', 'peak_pts')


USED = []                                                # (input, value, from GH or default)


def opt(name, default=None):
    """value of a component input; the default is used ONLY when the input is missing
    on the component or has no data. Every lookup is logged in the 'out' report"""
    v = globals().get(name, None)
    if v is None or v == []:
        USED.append((name, default, 'default'))
        return default
    USED.append((name, v, 'input'))
    return v


def as_int(v):
    """int from int / float / text such as "14" or "14.0" (Panel input)"""
    return int(round(float(str(v).strip()))) if not isinstance(v, (int, float)) else int(round(v))


def as_float(v):
    return float(str(v).strip()) if not isinstance(v, (int, float)) else float(v)


def as_bool(v):
    """bool from bool / number / text: "False", "0", "no", "" -> False"""
    if isinstance(v, str):
        return v.strip().lower() not in ('false', '0', 'no', 'off', 'none', '')
    return bool(v)


def report_inputs():
    lines = ['inputs:']
    for name, v, src in USED:
        if name in ('_mesh', '_values', '_filled_', '_colors_'):
            if src == 'input':
                try:
                    shown = '%d items' % len(v)
                except TypeError:
                    shown = type(v).__name__
            else:
                shown = '-'
        else:
            shown = str(v).replace('\r', ' ').replace('\n', ' | ')
            if len(shown) > 40:
                shown = shown[:37] + '...'
        lines.append('  %-18s %-8s %s' % (name, src, shown))
    print('\n'.join(lines))


run = as_bool(opt('_run', True))
mesh_in = opt('_mesh', None)
vals_in = opt('_values', None)
filled_in = opt('_filled_', None)
mode = str(opt('_mode_', 'cells')).strip().lower()
if mode not in ('smooth', 'contour'):
    mode = 'cells'
levels = max(2, as_int(opt('_levels_', 10)))
smooth_it = min(50, max(0, as_int(opt('_smooth_', 0))))
vmin_in, vmax_in = opt('_vmin_', None), opt('_vmax_', None)
cols_in = opt('_colors_', None)
title_in = opt('_legend_title_', None)
legend_pt = opt('_legend_pt_', None)
legend_scale = as_float(opt('_legend_scale_', 1.0))
legend_n = max(2, as_int(opt('_legend_n_', 6)))
dec = as_int(opt('_decimals_', 1))
range_labels = as_bool(opt('_range_labels_', False))
gtitle_in = opt('_global_title_', None)
gtitle_pt = opt('_title_pt_', None)
gtitle_scale = as_float(opt('_title_scale_', 1.0))
title_xz = as_bool(opt('_title_xz_', False))
label_spacing_in = opt('_label_spacing_', None)
label_size_in = opt('_label_size_', None)
label_min_len_in = opt('_label_min_len_', None)
peaks_on = as_bool(opt('_peaks_', True))
label_horizontal = as_bool(opt('_label_horizontal_', False))
peak_min_cells = max(1, as_int(opt('_peak_min_cells_', 10)))
peak_pos = str(opt('_peak_pos_', 'centre')).strip().lower()
if peak_pos not in ('centre', 'center', 'max', 'above'):
    peak_pos = 'centre'
peak_fit = as_bool(opt('_peak_fit_', False))
peak_value = str(opt('_peak_value_', 'max')).strip().lower()
if peak_value not in ('centre', 'center', 'max'):
    peak_value = 'max'


def to_color_array(py_list):
    """Python list of Color -> .NET Color[] in one conversion"""
    return System.Array[sd.Color](py_list)


def _struct_array(T, flat, per, net_type, make):
    """flat Python numbers -> .NET struct array (Point3d = 3 doubles, MeshFace = 4 ints)
    with one block memory copy instead of one .NET call per element"""
    n = len(flat) // per
    arr = System.Array.CreateInstance(T, n)
    if not n:
        return arr
    try:
        src = System.Array[net_type](flat)
        h = GCHandle.Alloc(arr, GCHandleType.Pinned)
        try:
            Marshal.Copy(src, 0, h.AddrOfPinnedObject(), len(flat))
        finally:
            h.Free()
    except Exception:                                    # safe fallback, slower
        for i in range(n):
            arr[i] = make(*flat[per * i:per * i + per])
    return arr


def point_array(flat_xyz):
    return _struct_array(rg.Point3d, flat_xyz, 3, System.Double, rg.Point3d)


def face_array(flat_abcd):
    return _struct_array(rg.MeshFace, flat_abcd, 4, System.Int32, rg.MeshFace)


def mesh_from_flat(flat_xyz, flat_abcd):
    mm = rg.Mesh()
    mm.Vertices.AddVertices(point_array(flat_xyz))
    mm.Faces.AddFaces(face_array(flat_abcd))
    return mm


def make_lut(pal):
    """256-step colour lookup table"""
    n = len(pal) - 1
    lut = []
    for s in range(256):
        t = s / 255.0 * n
        i = min(int(t), n - 1)
        f = t - i
        a, b = pal[i], pal[i + 1]
        lut.append(sd.Color.FromArgb(int(a[0] + (b[0] - a[0]) * f),
                                     int(a[1] + (b[1] - a[1]) * f),
                                     int(a[2] + (b[2] - a[2]) * f)))
    return lut


def build_mesh(values, filled, vmin, vmax, lut, bb, diag):
    nf = len(values)
    span = 255.0 / (vmax - vmin)

    # smooth / contour need neighbouring cells to SHARE vertices. The reader mesh is
    # unwelded (4 own vertices per cell) -> weld identical vertices natively first
    # (face order is kept, so values[f] still belongs to face f)
    if mode == 'cells':
        base = mesh_in
    else:
        base = mesh_in.DuplicateMesh()
        base.VertexColors.Clear()
        base.Vertices.CombineIdentical(True, True)
    nv = base.Vertices.Count

    def cols_of(vals):
        return [lut[0 if s < 0 else (255 if s > 255 else s)]
                for s in [int((v - vmin) * span + 0.5) for v in vals]]

    fi = list(base.Faces.ToIntArray(False))              # 4 vertex ids per face, one copy
    fcol = cols_of(values)                               # flat colour per face
    contours, contour_val = [], []
    iso_raw = []                                         # (flat xyz, value) per isoline
    peaks = []      # (centre x, y, z, room, max x, y, z, room, max value, n vertices, cell,
    #                  centre-cell value)

    def vertex_values():
        """average of the (non-filled) faces around each vertex"""
        acc, cnt = [0.0] * nv, [0] * nv
        for f in range(nf):
            if filled[f]:
                continue
            v = values[f]
            b = 4 * f
            a0, a1, a2, a3 = fi[b], fi[b + 1], fi[b + 2], fi[b + 3]
            acc[a0] += v
            acc[a1] += v
            acc[a2] += v
            cnt[a0] += 1
            cnt[a1] += 1
            cnt[a2] += 1
            if a3 != a2:
                acc[a3] += v
                cnt[a3] += 1
        vv = [acc[q] / cnt[q] if cnt[q] else None for q in range(nv)]
        if smooth_it:
            vv = smooth_values(vv)
        return vv

    def smooth_values(vv):
        """Laplacian smoothing over the cell edges of non-filled faces"""
        edges = set()
        for f in range(nf):
            if filled[f]:
                continue
            b = 4 * f
            a0, a1, a2, a3 = fi[b], fi[b + 1], fi[b + 2], fi[b + 3]
            ring = (a0, a1, a2, a3) if a3 != a2 else (a0, a1, a2)
            n = len(ring)
            for i in range(n):
                p, q = ring[i], ring[(i + 1) % n]
                edges.add((p, q) if p < q else (q, p))
        ea = [e[0] for e in edges]
        eb = [e[1] for e in edges]
        ne = len(ea)
        for _ in range(smooth_it):
            acc = [0.0 if v is None else v for v in vv]
            cnt = [1] * nv
            for i in range(ne):
                a, b = ea[i], eb[i]
                acc[a] += vv[b]
                acc[b] += vv[a]
                cnt[a] += 1
                cnt[b] += 1
            vv = [None if vv[q] is None else acc[q] / cnt[q] for q in range(nv)]
        return vv

    # ================= CELLS =================
    if mode == 'cells':
        m = mesh_in.DuplicateMesh()
        m.VertexColors.Clear()
        m.Unweld(0, True)
        fu = list(m.Faces.ToIntArray(False))
        vc = [lut[0]] * m.Vertices.Count
        for f in range(nf):
            b = 4 * f
            c = fcol[f]
            vc[fu[b]] = vc[fu[b + 1]] = vc[fu[b + 2]] = vc[fu[b + 3]] = c
        m.VertexColors.SetColors(to_color_array(vc))

    # ================= SMOOTH =================
    elif mode == 'smooth':
        vv = vertex_values()
        vcol = cols_of([vmin if v is None else v for v in vv])
        m = base.DuplicateMesh()
        m.VertexColors.Clear()
        if any(filled):                                  # keep buildings flat: split them off
            m.Unweld(0, True)
            fu = list(m.Faces.ToIntArray(False))
            vc = [lut[0]] * m.Vertices.Count
            for f in range(nf):
                b = 4 * f
                if filled[f]:
                    c = fcol[f]
                    vc[fu[b]] = vc[fu[b + 1]] = vc[fu[b + 2]] = vc[fu[b + 3]] = c
                else:                                    # own face guarantees a vertex value
                    vc[fu[b]] = vcol[fi[b]]
                    vc[fu[b + 1]] = vcol[fi[b + 1]]
                    vc[fu[b + 2]] = vcol[fi[b + 2]]
                    vc[fu[b + 3]] = vcol[fi[b + 3]]
            m.VertexColors.SetColors(to_color_array(vc))
        else:
            m.VertexColors.SetColors(to_color_array(vcol))

    # ================= CONTOUR =================
    else:
        vv = vertex_values()
        xyz = list(base.Vertices.ToFloatArray())         # x0, y0, z0, x1, ... one copy
        PT = [(xyz[3 * q], xyz[3 * q + 1], xyz[3 * q + 2]) for q in range(nv)]
        step = (vmax - vmin) / float(levels)
        inv = 1.0 / step
        L1 = levels - 1
        bounds = [vmin + step * i for i in range(levels + 1)]
        band_col = cols_of([vmin + step * (i + 0.5) for i in range(levels)])

        # per-vertex clamped value and band, computed once
        cv = [None if v is None else (vmin if v < vmin else (vmax if v > vmax else v))
              for v in vv]
        vb = [None if v is None else min(L1, int((v - vmin) * inv)) for v in cv]

        vflat, fflat, cols = [], [], []                  # pure Python buffers
        vext, fext, cext = vflat.extend, fflat.extend, cols.extend
        iso_adj = [{} for _ in range(levels + 1)]        # per level: edge key -> neighbour keys
        iso_pt = [{} for _ in range(levels + 1)]         # per level: edge key -> point

        def add_poly(pts, c):
            n = len(pts)
            if n < 3:
                return
            a = len(vflat) // 3
            for p in pts:
                vext(p)
            cext([c] * n)
            if n == 4:
                fext((a, a + 1, a + 2, a + 3))
            elif n == 3:
                fext((a, a + 1, a + 2, a + 2))
            else:
                for t in range(1, n - 1):                # fan
                    fext((a, a + t, a + t + 1, a + t + 1))

        def lerp(p, va, q, vb_, lv):
            t = (lv - va) / (vb_ - va)
            return (p[0] + (q[0] - p[0]) * t, p[1] + (q[1] - p[1]) * t,
                    p[2] + (q[2] - p[2]) * t)

        def clip(poly, lv, keep_above):
            """clip polygon [(pt, v)] against scalar level"""
            out = []
            n = len(poly)
            for i in range(n):
                p, vp = poly[i]
                q, vq = poly[(i + 1) % n]
                ip = (vp >= lv) if keep_above else (vp <= lv)
                iq = (vq >= lv) if keep_above else (vq <= lv)
                if ip:
                    out.append((p, vp))
                if ip != iq:
                    out.append((lerp(p, vp, q, vq, lv), lv))
            return out

        def triangle(ia, ib, ic, b0, b1):
            """only called for triangles crossing at least one band boundary"""
            tri = [(PT[ia], cv[ia]), (PT[ib], cv[ib]), (PT[ic], cv[ic])]
            for bi in range(b0, b1 + 1):                 # one polygon per crossed band
                poly = tri
                if bi > 0:
                    poly = clip(poly, bounds[bi], True)
                if bi < L1 and poly:
                    poly = clip(poly, bounds[bi + 1], False)
                add_poly([t[0] for t in poly], band_col[bi])
            ids = (ia, ib, ic)
            for li in range(b0 + 1, b1 + 1):             # isolines: edge-to-edge segments
                lv = bounds[li]
                pts = iso_pt[li]
                ks = []
                for e in range(3):
                    a, b = ids[e], ids[(e + 1) % 3]
                    if (cv[a] < lv) != (cv[b] < lv):
                        k = (a, b) if a < b else (b, a)  # shared mesh edge = exact join key
                        ks.append(k)
                        if k not in pts:
                            pts[k] = lerp(PT[k[0]], cv[k[0]], PT[k[1]], cv[k[1]], lv)
                if len(ks) == 2:
                    adj = iso_adj[li]
                    adj.setdefault(ks[0], []).append(ks[1])
                    adj.setdefault(ks[1], []).append(ks[0])

        def chains(adj):
            """walk the edge graph of one level into open / closed polylines"""
            seen = set()
            out = []
            ends = [k for k, n in adj.items() if len(n) == 1]
            for s in ends + list(adj.keys()):            # open chains first, then loops
                if s in seen:
                    continue
                path, cur = [s], s
                seen.add(s)
                while True:
                    nxt = None
                    for n in adj[cur]:
                        if n not in seen:
                            nxt = n
                            break
                    if nxt is None:
                        break
                    path.append(nxt)
                    seen.add(nxt)
                    cur = nxt
                out.append((path, len(path) > 2 and s in adj[cur]))
            return out

        # classify faces: drawn as-is (filled / no value / one band) or split into bands
        face_c = []                                      # colour of each as-is face, in order
        split = []                                       # faces crossing band boundaries
        for f in range(nf):
            b = 4 * f
            k0, k1, k2, k3 = vb[fi[b]], vb[fi[b + 1]], vb[fi[b + 2]], vb[fi[b + 3]]
            if filled[f] or k0 is None or k1 is None or k2 is None or k3 is None:
                face_c.append(fcol[f])
            elif k0 == k1 == k2 == k3:                   # whole face in one band
                face_c.append(band_col[k0])
            else:
                split.append(f)

        # part 1 (usually most faces): native copy -> delete split faces -> unweld
        m = base.DuplicateMesh()
        m.VertexColors.Clear()
        if split:
            m.Faces.DeleteFaces(System.Array[System.Int32](split), True)
        if m.Faces.Count:
            m.Unweld(0, True)
            fu = list(m.Faces.ToIntArray(False))
            vc = [lut[0]] * m.Vertices.Count
            for k in range(len(face_c)):
                b = 4 * k
                c = face_c[k]
                vc[fu[b]] = vc[fu[b + 1]] = vc[fu[b + 2]] = vc[fu[b + 3]] = c
            m.VertexColors.SetColors(to_color_array(vc))

        # part 2: band-crossing faces, clipped in Python (+ isoline segments)
        for f in split:
            b = 4 * f
            i0, i1, i2, i3 = fi[b], fi[b + 1], fi[b + 2], fi[b + 3]
            k0, k1, k2, k3 = vb[i0], vb[i1], vb[i2], vb[i3]
            lo, hi = min(k0, k1, k2), max(k0, k1, k2)
            if lo == hi:
                add_poly((PT[i0], PT[i1], PT[i2]), band_col[lo])
            else:
                triangle(i0, i1, i2, lo, hi)
            if i2 != i3:
                lo, hi = min(k0, k2, k3), max(k0, k2, k3)
                if lo == hi:
                    add_poly((PT[i0], PT[i2], PT[i3]), band_col[lo])
                else:
                    triangle(i0, i2, i3, lo, hi)
        if fflat:
            m2 = mesh_from_flat(vflat, fflat)
            m2.VertexColors.SetColors(to_color_array(cols))
            if m.Faces.Count:
                m.Append(m2)
            else:
                m = m2

        # ---- peaks: innermost closed contours around a local maximum
        # vertices are grouped into connected regions of the same band; a region whose
        # neighbours are all in LOWER bands and that does not touch the site edge / a building
        # is the inside of an innermost closed contour -> label its maximum cell value
        ecount = {}
        for f in range(nf):
            b = 4 * f
            i0, i1, i2, i3 = fi[b], fi[b + 1], fi[b + 2], fi[b + 3]
            if filled[f] or vb[i0] is None or vb[i1] is None or vb[i2] is None or vb[i3] is None:
                continue
            ring = (i0, i1, i2, i3) if i2 != i3 else (i0, i1, i2)
            n = len(ring)
            for e in range(n):
                a, c = ring[e], ring[(e + 1) % n]
                k = (a, c) if a < c else (c, a)
                ecount[k] = ecount.get(k, 0) + 1
        nbr = [[] for _ in range(nv)]
        nbr8 = [[] for _ in range(nv)]                   # edges + face diagonals (distances)
        for f in range(nf):
            b = 4 * f
            i0, i1, i2, i3 = fi[b], fi[b + 1], fi[b + 2], fi[b + 3]
            if i2 != i3 and not filled[f]:
                nbr8[i0].append(i2)
                nbr8[i2].append(i0)
                nbr8[i1].append(i3)
                nbr8[i3].append(i1)
        border = bytearray(nv)
        for (a, c), cnt in ecount.items():
            nbr[a].append(c)
            nbr[c].append(a)
            nbr8[a].append(c)
            nbr8[c].append(a)
            if cnt == 1:                                 # edge of the valid area
                border[a] = border[c] = 1
        # border vertices on the outer edge of the SITE (closes no contour); the other border
        # vertices are building walls, which are allowed to bound a zone
        tolb = 1e-6 * diag
        ext = [(bb.Min.X, bb.Max.X), (bb.Min.Y, bb.Max.Y), (bb.Min.Z, bb.Max.Z)]
        flat_ax = [hi_ - lo_ <= tolb for lo_, hi_ in ext]
        dom_edge = bytearray(nv)
        for v in range(nv):
            if border[v]:
                p_ = PT[v]
                for c_ in range(3):
                    if not flat_ax[c_] and (abs(p_[c_] - ext[c_][0]) <= tolb or
                                           abs(p_[c_] - ext[c_][1]) <= tolb):
                        dom_edge[v] = 1
                        break
        comp = [-1] * nv
        peak_comp = {}                                   # component id -> [n vertices, best val, face]
        ncomp = 0
        for v0 in range(nv):
            if comp[v0] != -1 or vb[v0] is None or not nbr[v0]:
                continue
            band = vb[v0]
            comp[v0] = ncomp
            stack, members, is_peak, has_nbr = [v0], [], True, False
            while stack:
                v = stack.pop()
                members.append(v)
                if dom_edge[v]:                          # touches the site edge: not closed
                    is_peak = False
                for w in nbr[v]:
                    bw = vb[w]
                    if bw == band:
                        if comp[w] == -1:
                            comp[w] = ncomp
                            stack.append(w)
                    else:
                        has_nbr = True
                        if bw > band:
                            is_peak = False
            if is_peak and has_nbr:
                peak_comp[ncomp] = [members, None, -1]
            ncomp += 1
        if peak_comp:
            # A hill = one core (innermost closed contour). Its ZONE is the smallest closed
            # contour around the core that is big enough to be a real area: start at the
            # core's band and step out one contour level at a time while the zone is too
            # small / too thin. The zone = connected set of vertices >= that level.
            import heapq
            b0 = 0                                       # typical cell width (first valid quad)
            while b0 < nf and filled[b0]:
                b0 += 1
            b0 = 4 * min(b0, nf - 1)
            pa, pb = PT[fi[b0]], PT[fi[b0 + 1]]
            cell_w = ((pa[0] - pb[0]) ** 2 + (pa[1] - pb[1]) ** 2 + (pa[2] - pb[2]) ** 2) ** 0.5

            vfaces = [[] for _ in range(nv)]             # valid cells around each vertex
            for f in range(nf):
                if filled[f]:
                    continue
                b = 4 * f
                ids = (fi[b], fi[b + 1], fi[b + 2], fi[b + 3]) if fi[b + 2] != fi[b + 3] else \
                      (fi[b], fi[b + 1], fi[b + 2])
                if any(vb[q] is None for q in ids):
                    continue
                for q in ids:
                    vfaces[q].append(f)

            def corners(ff):
                bq = 4 * ff
                return (fi[bq], fi[bq + 1], fi[bq + 2], fi[bq + 3]) if fi[bq + 2] != fi[bq + 3] \
                    else (fi[bq], fi[bq + 1], fi[bq + 2])

            def zone_at(seed, level):
                """connected vertices with band >= level around seed; None if it reaches the
                outer edge of the site (contour not closed). Building walls may bound it"""
                zone, stack = {seed: 1}, [seed]
                while stack:
                    v = stack.pop()
                    if dom_edge[v]:                      # reaches the site edge
                        return None
                    for w in nbr[v]:
                        if w not in zone and vb[w] is not None and vb[w] >= level:
                            zone[w] = 1
                            stack.append(w)
                return zone

            def analyse(zone):
                """cells fully inside, max cell, distance to the zone edge, centre cell"""
                cells = set()
                for v in zone:
                    for ff in vfaces[v]:
                        cells.add(ff)
                cells = [ff for ff in cells if all(r in zone for r in corners(ff))]
                if not cells:
                    return None
                fmax = max(cells, key=lambda ff: values[ff])
                cs = corners(fmax)
                mx = sum(PT[r][0] for r in cs) / len(cs)
                my = sum(PT[r][1] for r in cs) / len(cs)
                mz = sum(PT[r][2] for r in cs) / len(cs)
                dist = {}
                for v in zone:                           # isoline crosses edge v-w ~ half way
                    if border[v]:                        # building wall bounds the zone too
                        dist[v] = 0.0
                    for w in nbr[v]:
                        if w not in zone:
                            p0, p1 = PT[v], PT[w]
                            d0 = 0.5 * ((p0[0] - p1[0]) ** 2 + (p0[1] - p1[1]) ** 2 +
                                        (p0[2] - p1[2]) ** 2) ** 0.5
                            if d0 < dist.get(v, 1e300):
                                dist[v] = d0
                heap = [(d, v) for v, d in dist.items()]
                heapq.heapify(heap)
                while heap:
                    d, v = heapq.heappop(heap)
                    if d > dist[v]:
                        continue
                    p0 = PT[v]
                    for w in nbr8[v]:
                        if w not in zone:
                            continue
                        p1 = PT[w]
                        nd = d + ((p0[0] - p1[0]) ** 2 + (p0[1] - p1[1]) ** 2 +
                                  (p0[2] - p1[2]) ** 2) ** 0.5
                        if nd < dist.get(w, 1e300):
                            dist[w] = nd
                            heapq.heappush(heap, (nd, w))
                best_key = None                          # centre cell = deepest cell of the zone
                for ff in cells:
                    cs = corners(ff)
                    d = sum(dist.get(r, 0.0) for r in cs) / len(cs)
                    x = sum(PT[r][0] for r in cs) / len(cs)
                    y = sum(PT[r][1] for r in cs) / len(cs)
                    z = sum(PT[r][2] for r in cs) / len(cs)
                    k = (round(d, 6), -((x - mx) ** 2 + (y - my) ** 2 + (z - mz) ** 2))
                    if best_key is None or k > best_key:
                        best_key, fc, cpt, room_c = k, ff, (x, y, z), d
                cs = corners(fmax)
                room_m = sum(dist.get(r, 0.0) for r in cs) / len(cs)
                return (cpt[0], cpt[1], cpt[2], room_c, mx, my, mz, room_m,
                        values[fmax], len(zone), cell_w, values[fc])

            done = {}                                    # zones already labelled (shared hills)
            for cid, (members, _b, _f) in peak_comp.items():
                seed = members[0]
                level = top = vb[seed]
                while level >= 0:
                    zone = zone_at(seed, level)
                    if zone is None:                     # contour no longer closed: give up
                        break
                    if any(vb[v] > top for v in zone):   # merged with a higher hill: that hill
                        break                            # gets its own label, not this one
                    key = (level, min(zone))
                    if key in done:                      # same zone as a higher hill: skip
                        break
                    res = analyse(zone) if len(zone) >= peak_min_cells else None
                    if res is not None and res[3] >= 0.75 * cell_w:
                        done[key] = 1
                        peaks.append(res)
                        break
                    level -= 1                           # too small / thin: next contour out

        # ---- isolines: chain segments through shared mesh edges (no JoinCurves needed)
        for li in range(1, levels):
            pts = iso_pt[li]
            for path, closed in chains(iso_adj[li]):
                if len(path) < 2:
                    continue
                buf = []
                for k in path:
                    buf.extend(pts[k])
                if closed:
                    buf.extend(pts[path[0]])
                pl = rg.Polyline(len(buf) // 3)
                pl.AddRange(point_array(buf))
                contours.append(rg.PolylineCurve(pl))
                contour_val.append(bounds[li])
                iso_raw.append((buf, bounds[li]))

    m.Normals.ComputeNormals()
    return m, contours, contour_val, iso_raw, peaks


def build_iso_labels(iso_raw, peaks, bb, diag):
    """value labels along the isolines: evenly spaced, aligned with the line,
    always readable, labels of different lines kept apart"""
    size = float(label_size_in) if label_size_in else 0.012 * diag
    spacing = float(label_spacing_in) if label_spacing_in else 0.15 * diag
    spacing = max(spacing, 1e-6)
    min_len = float(label_min_len_in) if label_min_len_in is not None else 0.3 * spacing
    planes, txts, vals = [], [], []
    pk_planes, pk_txt, pk_val, pk_pts = [], [], [], []
    if not iso_raw and not peaks:
        return planes, txts, size, vals, pk_planes, pk_txt, pk_val, pk_pts

    # plane of the map: plan (z flat) or vertical section (x or y flat)
    ex, ey, ez = bb.Max.X - bb.Min.X, bb.Max.Y - bb.Min.Y, bb.Max.Z - bb.Min.Z
    if ez <= ex and ez <= ey:
        nrm, up = (0.0, 0.0, 1.0), (0.0, 1.0, 0.0)       # plan: text up = +Y
    elif ey <= ex:
        nrm, up = (0.0, -1.0, 0.0), (0.0, 0.0, 1.0)      # XZ section, seen from the front
    else:
        nrm, up = (1.0, 0.0, 0.0), (0.0, 0.0, 1.0)       # YZ section, seen from the right
    fmt = '%.' + str(max(0, dec)) + 'f'
    gap = max(0.35 * spacing, 4.0 * size)                # min distance between any two labels
    gap2 = gap * gap
    grid = {}

    def free(px, py, pz):
        ki, kj, kk = int(px // gap), int(py // gap), int(pz // gap)
        for a in (ki - 1, ki, ki + 1):
            for b in (kj - 1, kj, kj + 1):
                for c in (kk - 1, kk, kk + 1):
                    for (qx, qy, qz) in grid.get((a, b, c), ()):
                        if (px - qx) ** 2 + (py - qy) ** 2 + (pz - qz) ** 2 < gap2:
                            return False
        grid.setdefault((ki, kj, kk), []).append((px, py, pz))
        return True

    # horizontal reading direction of the map (peak labels, _label_horizontal_)
    hx = (0.0, 1.0, 0.0) if nrm[0] else (1.0, 0.0, 0.0)
    hy = up
    tol = 1e-6 * diag
    lo = (bb.Min.X - tol, bb.Min.Y - tol, bb.Min.Z - tol)
    hi = (bb.Max.X + tol, bb.Max.Y + tol, bb.Max.Z + tol)

    def fits(o, X, Y, w, h):
        """True if the whole text box (origin o, width w along X, height h along Y)
        lies inside the simulation domain"""
        mg = 0.3 * h                                     # safety margin around the text;
        # vertical extent -h..2h covers both bottom- and top-anchored text displays
        for a, b in ((-mg, -h - mg), (w + mg, -h - mg), (-mg, h + mg), (w + mg, h + mg)):
            for c in range(3):
                v = o[c] + X[c] * a + Y[c] * b
                if v < lo[c] or v > hi[c]:
                    return False
        return True

    def clamp_box(o, X, Y, w, h):
        """shift a text box (axis-aligned X / Y) back inside the domain"""
        mg = 0.5 * h
        o = list(o)
        for c in range(3):
            ext = abs(X[c]) * w + abs(Y[c]) * h
            if o[c] + ext + mg * (abs(X[c]) + abs(Y[c])) > hi[c]:
                o[c] = hi[c] - ext - mg * (abs(X[c]) + abs(Y[c]))
            if o[c] - mg * (abs(X[c]) + abs(Y[c])) < lo[c]:
                o[c] = lo[c] + mg * (abs(X[c]) + abs(Y[c]))
        return o

    # typical cell width (for the thin-strip test of the peaks)
    cell_w = max(peaks[0][10], 1e-9) if peaks else 1e-9

    # peaks first (one label at the maximum of each innermost closed contour)
    if peaks_on:
        use_max = peak_value == 'max'
        for (cx, cy, cz, room_c, mx, my, mz, room_m, vmax_c, ncell, _cw, vcen) in \
                sorted(peaks, key=lambda p: -(p[8] if use_max else p[11])):
            if ncell < peak_min_cells:
                continue
            val = vmax_c if use_max else vcen            # value shown on the label
            txt = fmt % val
            half_w = 0.33 * size * len(txt)
            if peak_pos == 'max':
                px, py, pz, room, dy_ = mx, my, mz, room_m, 0.0
            elif peak_pos == 'above':                    # text sits just above the max cell
                px, py, pz, room, dy_ = mx, my, mz, None, 0.9 * size
            else:
                px, py, pz, room, dy_ = cx, cy, cz, room_c, 0.0
            if room_c < 0.75 * cell_w:                   # one-cell-wide strip: no real centre
                continue
            # text must fit inside its contour: half diagonal of the text box <= room
            if peak_fit and room is not None and \
                    (half_w * half_w + 0.25 * size * size) ** 0.5 > room:
                continue
            if not free(px, py, pz):                     # higher peaks win, no overlaps
                continue
            o = (px - hx[0] * half_w - hy[0] * (0.5 * size - dy_),
                 py - hx[1] * half_w - hy[1] * (0.5 * size - dy_),
                 pz - hx[2] * half_w - hy[2] * (0.5 * size - dy_))
            ox, oy, oz = clamp_box(o, hx, hy, 2 * half_w, size)
            pk_planes.append(rg.Plane(rg.Point3d(ox, oy, oz), rg.Vector3d(*hx), rg.Vector3d(*hy)))
            pk_txt.append(txt)
            pk_val.append(val)
            pk_pts.append(rg.Point3d(mx, my, mz) if use_max else rg.Point3d(cx, cy, cz))

    # longest lines first, so they get their labels before short neighbours
    order = []
    for buf, val in iso_raw:
        n = len(buf) // 3
        cum = [0.0]
        for i in range(n - 1):
            q = 3 * i
            cum.append(cum[-1] + ((buf[q + 3] - buf[q]) ** 2 + (buf[q + 4] - buf[q + 1]) ** 2 +
                                  (buf[q + 5] - buf[q + 2]) ** 2) ** 0.5)
        if cum[-1] >= min_len and n >= 2:
            order.append((cum[-1], buf, cum, val))
    order.sort(key=lambda x: -x[0])

    for L, buf, cum, val in order:
        txt = fmt % val
        half_w = 0.33 * size * len(txt)                   # ~ half text width
        k = max(1, int(L // spacing))
        i = 0
        for j in range(k):
            s_at = (j + 0.5) * L / k
            while i < len(cum) - 2 and cum[i + 1] < s_at:
                i += 1
            q = 3 * i
            seg = cum[i + 1] - cum[i]
            t = (s_at - cum[i]) / seg if seg > 1e-12 else 0.0
            dx, dy, dz = buf[q + 3] - buf[q], buf[q + 4] - buf[q + 1], buf[q + 5] - buf[q + 2]
            px, py, pz = buf[q] + dx * t, buf[q + 1] + dy * t, buf[q + 2] + dz * t
            ln = (dx * dx + dy * dy + dz * dz) ** 0.5
            if ln < 1e-12:
                continue
            if label_horizontal:                         # straight text, centred on the line
                dx, dy, dz = hx
                yx, yy, yz = hy
            else:                                        # text follows the line
                dx, dy, dz = dx / ln, dy / ln, dz / ln
                yx = nrm[1] * dz - nrm[2] * dy            # y = normal x tangent
                yy = nrm[2] * dx - nrm[0] * dz
                yz = nrm[0] * dy - nrm[1] * dx
                if yx * up[0] + yy * up[1] + yz * up[2] < 0:   # keep the text readable
                    dx, dy, dz, yx, yy, yz = -dx, -dy, -dz, -yx, -yy, -yz
            ox = px - dx * half_w - yx * 0.5 * size      # centre the text on the line
            oy = py - dy * half_w - yy * 0.5 * size
            oz = pz - dz * half_w - yz * 0.5 * size
            if not fits((ox, oy, oz), (dx, dy, dz), (yx, yy, yz), 2 * half_w, size):
                continue                                 # text would stick out of the domain
            if not free(px, py, pz):
                continue
            planes.append(rg.Plane(rg.Point3d(ox, oy, oz), rg.Vector3d(dx, dy, dz),
                                   rg.Vector3d(yx, yy, yz)))
            txts.append(txt)
            vals.append(val)
    return planes, txts, size, vals, pk_planes, pk_txt, pk_val, pk_pts


def build_legend(vmin, vmax, lut, bb, diag, dmin, dmax):
    span = 255.0 / (vmax - vmin)

    def col(v):
        s = int((v - vmin) * span + 0.5)
        return lut[0 if s < 0 else (255 if s > 255 else s)]

    h = 0.4 * diag * legend_scale
    w = 0.075 * h
    text_size = 0.5 * w
    if legend_pt:
        lp = legend_pt
    elif title_xz:                                     # upright legend, bottom at the map base
        lp = rg.Point3d(bb.Max.X + 0.05 * diag, bb.Min.Y,
                        bb.Min.Z if is_xz_section(bb) else bb.Max.Z)
    else:
        lp = rg.Point3d(bb.Max.X + 0.05 * diag, bb.Min.Y, bb.Max.Z)

    def P(u, v):
        """legend coordinates (u = right, v = up) -> world point, flat XY or upright XZ"""
        if title_xz:
            return rg.Point3d(lp.X + u, lp.Y, lp.Z + v)
        return rg.Point3d(lp.X + u, lp.Y + v, lp.Z)

    contour_mode = mode == 'contour'
    nseg = levels if contour_mode else 32
    legend = rg.Mesh()
    lcols = []
    for s in range(nseg):
        y0 = h * s / float(nseg)
        y1 = h * (s + 1) / float(nseg)
        if contour_mode:
            c0 = c1 = col(vmin + (vmax - vmin) * (s + 0.5) / nseg)
        else:
            c0 = col(vmin + (vmax - vmin) * s / float(nseg))
            c1 = col(vmin + (vmax - vmin) * (s + 1) / float(nseg))
        a = legend.Vertices.Count
        legend.Vertices.Add(P(0.0, y0))
        legend.Vertices.Add(P(w, y0))
        legend.Vertices.Add(P(w, y1))
        legend.Vertices.Add(P(0.0, y1))
        lcols.extend((c0, c0, c1, c1))
        legend.Faces.AddFace(a, a + 1, a + 2, a + 3)
    legend.VertexColors.SetColors(to_color_array(lcols))
    legend.Normals.ComputeNormals()

    fmt = '%.' + str(max(0, dec)) + 'f'
    nlab = levels + 1 if contour_mode else legend_n        # number of tick values
    tag_pts, tag_txt = [], []
    lx = 1.5 * w                                           # local u of the value labels
    if range_labels:
        nr = nlab - 1                                      # one range per interval
        tol = 1e-9 * (vmax - vmin)
        for s in range(nr):
            a = vmin + (vmax - vmin) * s / float(nr)
            b = vmin + (vmax - vmin) * (s + 1) / float(nr)
            if s == 0 and dmin < vmin - tol:
                txt = '< ' + fmt % b
            elif s == nr - 1 and dmax > vmax + tol:
                txt = '>= ' + fmt % a
            else:
                txt = fmt % a + ' - ' + fmt % b
            t = (s + 0.5) / nr                             # middle of the interval
            tag_pts.append(P(lx, h * t - 0.5 * text_size))
            tag_txt.append(txt)
    else:
        for s in range(nlab):
            t = s / float(nlab - 1)
            tag_pts.append(P(lx, h * t - 0.5 * text_size))
            tag_txt.append(fmt % (vmin + (vmax - vmin) * t))

    # title: one tag per line, bottom-up (last line sits just above the bar)
    if title_in:
        lines = split_lines(title_in)
        line_h = 1.5 * text_size
        y = h + 1.0 * text_size                            # baseline of the bottom line
        for ln in reversed(lines):
            if ln.strip():
                tag_pts.append(P(0.0, y))
                tag_txt.append(ln)
            y += line_h
    return legend, tag_pts, tag_txt, text_size


def split_lines(txt):
    lines = str(txt).replace('\r\n', '\n').replace('\r', '\n').split('\n')
    while lines and not lines[-1].strip():
        lines.pop()
    return lines


def build_global_title(bb, diag):
    """global title under the mesh: one tag per line, first line on top"""
    size = 0.025 * diag * gtitle_scale
    if not gtitle_in:
        return [], [], size
    line_h = 1.5 * size
    lines = split_lines(gtitle_in)
    pts, txt = [], []
    if title_xz:                                         # upright: lines stacked along -Z
        if gtitle_pt:
            x, y, z = gtitle_pt.X, gtitle_pt.Y, gtitle_pt.Z - size     # baseline of line 1
        elif is_xz_section(bb):                          # under the section
            x, y, z = bb.Min.X, bb.Min.Y, bb.Min.Z - 0.04 * diag - size
        else:                                            # plan: in front of the map, last line
            x, y = bb.Min.X, bb.Min.Y - 0.04 * diag      # standing on the map level
            z = bb.Max.Z + (len(lines) - 1) * line_h
        for ln in lines:
            if ln.strip():
                pts.append(rg.Point3d(x, y, z))
                txt.append(ln)
            z -= line_h
        return pts, txt, size
    if gtitle_pt:
        x, y, z = gtitle_pt.X, gtitle_pt.Y - size, gtitle_pt.Z      # baseline of line 1
    else:
        x, y, z = bb.Min.X, bb.Min.Y - 0.04 * diag - size, bb.Max.Z
    for ln in lines:
        if ln.strip():
            pts.append(rg.Point3d(x, y, z))
            txt.append(ln)
        y -= line_h
    return pts, txt, size


def is_xz_section(bb):
    """True if the map itself is a vertical XZ section (flat in Y)"""
    ex, ey, ez = bb.Max.X - bb.Min.X, bb.Max.Y - bb.Min.Y, bb.Max.Z - bb.Min.Z
    return ey <= 1e-6 * (ex + ez + 1.0) and ez > ey


def to_xz_planes(pts):
    """text locations -> planes in the vertical XZ plane (x = reading direction, y = up)"""
    return [rg.Plane(p, rg.Vector3d.XAxis, rg.Vector3d.ZAxis) for p in pts]


def cache_slot():
    """per-component sticky key (None if not available)"""
    try:
        return 'envimet_heatmap_' + str(ghenv.Component.InstanceGuid)  # noqa: F821
    except Exception:
        return None


def build():
    t_start = time.time()
    if mesh_in is None or not vals_in:
        raise ValueError('Connect _mesh and _values (set _values to List Access).')
    values = [float(v) for v in vals_in]
    nf = mesh_in.Faces.Count
    if len(values) != nf:
        raise ValueError('%d values for %d mesh faces - connect mesh and values from the '
                         'same reader component.' % (len(values), nf))
    if filled_in and len(filled_in) == nf:
        filled = [bool(f) for f in filled_in]
    else:
        if filled_in:
            print('WARNING: _filled_ has %d items for %d faces - ignored' % (len(filled_in), nf))
        filled = [False] * nf

    vmin = float(vmin_in) if vmin_in is not None else min(values)
    vmax = float(vmax_in) if vmax_in is not None else max(values)
    if vmax - vmin < 1e-9:
        vmax = vmin + 1e-6

    pal = [(c.R, c.G, c.B) for c in cols_in] if cols_in else LB_COLORS
    if len(pal) < 2:
        pal = LB_COLORS
    lut = make_lut(pal)

    bb = mesh_in.GetBoundingBox(True)
    diag = bb.Diagonal.Length or 1.0

    # ---- geometry (cached: legend-only changes skip this)
    key = ('v9', mode, levels if mode == 'contour' else 0,
           smooth_it if mode != 'cells' else 0, vmin, vmax, tuple(pal), nf,
           mesh_in.Vertices.Count, str(bb.Min), str(bb.Max),
           hash(tuple(values)), hash(tuple(filled)))
    slot = cache_slot()
    cached = sc.sticky.get(slot) if (sc is not None and slot) else None
    if cached is not None and cached[0] == key:
        m, contours, contour_val, iso_raw, peaks = cached[1:6]
        src = 'cached'
    else:
        m, contours, contour_val, iso_raw, peaks = build_mesh(values, filled, vmin, vmax, lut,
                                                               bb, diag)
        if sc is not None and slot:
            sc.sticky[slot] = (key, m, contours, contour_val, iso_raw, peaks)
        src = 'computed'

    legend, tag_pts, tag_txt, text_size = build_legend(vmin, vmax, lut, bb, diag,
                                                       min(values), max(values))
    title_pts, title_txt, title_size = build_global_title(bb, diag)
    if title_xz:                                         # Text Tag 3D needs planes to stand up
        tag_pts = to_xz_planes(tag_pts)
        title_pts = to_xz_planes(title_pts)
    (iso_planes, iso_txt, iso_size, iso_val,
     peak_planes, peak_txt, peak_val, peak_pts) = build_iso_labels(iso_raw, peaks, bb, diag)

    print('%s%s | %d cells | range %.2f - %.2f%s | %s in %.0f ms' % (
        mode, (' (smooth x%d)' % smooth_it) if smooth_it and mode != 'cells' else '',
        nf, vmin, vmax,
        (' | %d isolines, %d labels, %d peaks' % (len(contours), len(iso_txt), len(peak_txt)))
        if mode == 'contour' else '',
        src, (time.time() - t_start) * 1000.0))
    return dict(mesh=m, contours=contours, contour_val=contour_val, legend=legend,
                tag_pts=tag_pts, tag_txt=tag_txt, text_size=text_size, v_range=(vmin, vmax),
                title_pts=title_pts, title_txt=title_txt, title_size=title_size,
                iso_planes=iso_planes, iso_txt=iso_txt, iso_size=iso_size, iso_val=iso_val,
                peak_planes=peak_planes, peak_txt=peak_txt, peak_val=peak_val, peak_pts=peak_pts)


set_tooltips(TIPS_IN, TIPS_OUT,
             'Meerkat - fast heatmap / contour map with legend for ENVI-met data')
report_inputs()
if run:
    result = build()
else:
    print('_run is False - nothing computed, outputs empty')
    result = dict((n, None) for n in OUTS)
mesh, contours, contour_val = result['mesh'], result['contours'], result['contour_val']
legend, tag_pts, tag_txt = result['legend'], result['tag_pts'], result['tag_txt']
text_size, v_range = result['text_size'], result['v_range']
title_pts, title_txt, title_size = result['title_pts'], result['title_txt'], result['title_size']
iso_planes, iso_txt, iso_size, iso_val = (result['iso_planes'], result['iso_txt'],
                                          result['iso_size'], result['iso_val'])
peak_planes, peak_txt, peak_val, peak_pts = (result['peak_planes'], result['peak_txt'],
                                             result['peak_val'], result['peak_pts'])
# ---------- end heatmap ----------
point_probe = Python3Script()  # -> out, var_names, x_levels, y_levels, z_levels, used_vars, values, first_vals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; inputs pts: list of Point3d, edx: String, vars: list of String, axis: String, k: Int32, skip_bldg: Boolean, decimals: Int32, csv: String, origin: Point3d, run: Boolean
# ---------- point_probe: Python ----------
"""ENVI-met point probe: value of the grid cell nearest to each input point
Runs in GhPython (IronPython 2.7, Rhino 7) and Python 3 (Rhino 8). No numpy needed.

For every input point, finds the ENVI-met cell that contains it (= the nearest cell
centre), optionally steps out of building cells to the nearest air cell, and returns the
values of the chosen variables plus ready-made labels.

Inputs (only _run, _pts and _edx are required):
    _run        : bool         - set to True to run (connect a Boolean Toggle / Button)
    _pts        : list Point3d - probe points (LIST ACCESS)
    _edx        : str          - path to the .EDX file (.EDT with same name, same folder)
    _vars_      : list str     - variables to read (LIST ACCESS): full name, part of it
                                 ("air temp", "wind speed") or index. Default: air
                                 temperature, wind speed, relative humidity (if present)
    _skip_bldg_ : bool         - point inside a building -> use nearest air cell
                                 (default True); False = return None there
    _decimals_  : int          - decimals in labels (default 2)
    _csv_       : str          - optional path; writes the table as a .csv file
    _axis_      : str          - lock probing to one slice of the data, same as the heatmap
                                 script: "z" = plan at level _k, "x" = YZ section at column
                                 _k, "y" = XZ section at row _k. The point's coordinate
                                 along that axis is ignored. Empty = use the point's own
                                 3D position (default)
    _k          : int          - slice index for _axis_ (see x/y/z_levels), default 0
    _origin_    : Point3d      - model origin in Rhino (same as the other scripts)
Outputs:
    var_names   : all variables in the file (to pick _vars_)
    x_levels, y_levels, z_levels : cell-centre coordinates (m) - use to pick _k
    used_vars   : variables actually read
    values      : DataTree, one branch per point, one item per variable
    first_vals  : value of the first variable per point (flat list, e.g. for colouring)
    cells       : centre point of the cell used for each point
    ijk         : "i,j,k" index of that cell
    dist        : distance from input point to the cell centre (m)
    labels      : multi-line text per point -> Text Tag 3D (with tag_pts)
    labels_val  : values + units only, one line per variable (e.g. "30.12 °C");
                  empty for points inside buildings / outside the domain
    tag_pts     : label positions (input points; with _axis_ projected onto the slice)
    table       : CSV lines (header + one line per point)
"""
import io
import re
import os
import bisect
from array import array
import Rhino.Geometry as rg
import scriptcontext as sc
from Grasshopper import DataTree
from Grasshopper.Kernel.Data import GH_Path

NODATA = -999.0


def opt(name, default=None):
    v = globals().get(name, default)
    return default if v is None or v == [] else v


run_on = bool(opt('_run', False))
pts_in = opt('_pts', [])
if not isinstance(pts_in, (list, tuple)):
    pts_in = list(pts_in) if hasattr(pts_in, '__iter__') else [pts_in]
pts_in = [p for p in pts_in if p is not None]
vars_in = opt('_vars_', None)
if vars_in is not None and not isinstance(vars_in, (list, tuple)):
    vars_in = list(vars_in) if hasattr(vars_in, '__iter__') and not isinstance(vars_in, str) else [vars_in]
skip_bldg = bool(opt('_skip_bldg_', True))
dec = int(opt('_decimals_', 2))
csv_path = opt('_csv_', None)
o = opt('_origin_', rg.Point3d(0, 0, 0))
axis = str(opt('_axis_', '')).strip().lower()
axis = axis if axis in ('x', 'y', 'z') else None
k_in = int(opt('_k', 0))

# outputs stay empty until _run is True
var_names = x_levels = y_levels = z_levels = used_vars = None
values = first_vals = cells = ijk = dist = labels = labels_val = tag_pts = table = None


# ---------- header helpers ----------
def tag(txt, name):
    m = re.search(r'<%s>(.*?)</%s>' % (name, name), txt, re.S | re.I)
    return m.group(1).strip() if m else None


def floats(s):
    return [float(v) for v in s.replace('\n', ',').split(',') if v.strip()]


def edges(sp):
    e = [0.0]
    for d in sp:
        e.append(e[-1] + d)
    return e


def norm(s):
    return re.sub(r'[^a-z0-9]', '', s.lower())


def decode_text(raw):
    """EDX files are usually UTF-8; older ones ANSI. Also repairs mojibake like 'Â°C'."""
    for enc in ('utf-8', 'cp1252', 'latin-1'):
        try:
            txt = raw.decode(enc)
            break
        except (UnicodeDecodeError, LookupError):
            continue
    for bad, good in ((u'\u00c3\u201a\u00c2\u00b0', u'\u00b0'), (u'\u00c2\u00b0', u'\u00b0'),
                      (u'\u00c2\u00b2', u'\u00b2'), (u'\u00c2\u00b3', u'\u00b3'),
                      (u'\u00c2\u00b5', u'\u00b5')):
        txt = txt.replace(bad, good)
    return txt


def cell_of(e, x):
    i = bisect.bisect_right(e, x) - 1
    return min(max(i, 0), len(e) - 2)


def run():
    if not pts_in:
        raise ValueError('Connect _pts (set the input to List Access).')

    # ---------- header ----------
    with open(_edx, 'rb') as f:
        txt = decode_text(f.read())
    nx, ny, nz = [int(tag(txt, t)) for t in ('nr_xdata', 'nr_ydata', 'nr_zdata')]
    xe, ye, ze = [edges(floats(tag(txt, t))) for t in ('spacing_x', 'spacing_y', 'spacing_z')]
    xc = [(xe[i] + xe[i + 1]) / 2 for i in range(nx)]
    yc = [(ye[i] + ye[i + 1]) / 2 for i in range(ny)]
    zc = [(ze[i] + ze[i + 1]) / 2 for i in range(nz)]
    vnames = [s.strip() for s in tag(txt, 'name_variables').split(',') if s.strip()]
    if axis:
        lim = {'x': nx, 'y': ny, 'z': nz}[axis]
        if not 0 <= k_in < lim:
            raise ValueError('_k must be in range 0..%d for _axis_ %s' % (lim - 1, axis))

    def find_var(q):
        try:
            i = int(q)
            if 0 <= i < len(vnames):
                return i
        except (ValueError, TypeError):
            pass
        key = norm(str(q))
        for i, n in enumerate(vnames):
            if norm(n) == key:
                return i
        for i, n in enumerate(vnames):
            if key in norm(n):
                return i
        return None

    if vars_in:
        idx = []
        for q in vars_in:
            i = find_var(q)
            if i is None:
                raise ValueError('Variable "%s" not found. Check var_names.' % q)
            idx.append(i)
    else:                                               # sensible defaults
        idx = [i for i in (find_var('potentialairtemp') if find_var('potentialairtemp') is not None
                           else find_var('airtemp'),
                           find_var('windspeed'), find_var('relativehum')) if i is not None]
        if not idx:
            idx = [0]
    uvars = [vnames[i] for i in idx]

    # ---------- read needed variables (cached per file + variable) ----------
    edt = os.path.splitext(_edx)[0] + '.EDT'
    if not os.path.exists(edt):
        edt = os.path.splitext(_edx)[0] + '.edt'
    n2, n3 = nx * ny, nx * ny * nz
    stamp = (os.path.getmtime(_edx), os.path.getmtime(edt))
    cache = sc.sticky.get('envimet_probe_cache')
    if not cache or cache.get('key') != (_edx, stamp):
        cache = {'key': (_edx, stamp)}
        sc.sticky['envimet_probe_cache'] = cache

    def block(vi):
        if vi not in cache:
            with open(edt, 'rb') as f:
                f.seek(vi * n3 * 4)
                buf = f.read(n3 * 4)
            a = array('f')
            try:
                a.frombytes(buf)
            except AttributeError:
                a.fromstring(buf)
            cache[vi] = a
        return cache[vi]

    data = [block(i) for i in idx]
    ref = data[0]                                       # building cells = NODATA

    def is_air(i, j, k):
        return ref[k * n2 + j * nx + i] > NODATA + 1

    def nearest_air(x, y, z, i0, j0, k0, rmax=4):
        best, bd = None, None
        for r in range(1, rmax + 1):
            rk = 0 if axis == 'z' else r                # stay on the slice
            rj = 0 if axis == 'y' else r
            ri = 0 if axis == 'x' else r
            for k in range(max(k0 - rk, 0), min(k0 + rk, nz - 1) + 1):
                for j in range(max(j0 - rj, 0), min(j0 + rj, ny - 1) + 1):
                    for i in range(max(i0 - ri, 0), min(i0 + ri, nx - 1) + 1):
                        if max(abs(i - i0), abs(j - j0), abs(k - k0)) != r or not is_air(i, j, k):
                            continue
                        d = (xc[i] - x) ** 2 + (yc[j] - y) ** 2 + (zc[k] - z) ** 2
                        if bd is None or d < bd:
                            best, bd = (i, j, k), d
            if best:
                return best
        return None

    # ---------- probe ----------
    vtree = DataTree[object]()
    fv, cl, ij, ds, lb, lv, tps = [], [], [], [], [], [], []
    short = [re.sub(r'\s*\(.*?\)', '', n) for n in uvars]
    units = [(re.search(r'\((.*?)\)', n).group(1) if re.search(r'\((.*?)\)', n) else '') for n in uvars]
    tbl = ['point,x,y,z,i,j,k,dist_m,' + ','.join('"%s"' % n for n in uvars)]
    fmt = '%.' + str(dec) + 'f'

    for n, p in enumerate(pts_in):
        x, y, z = p.X - o.X, p.Y - o.Y, p.Z - o.Z
        if axis == 'z':                                 # snap onto the chosen slice
            z = zc[k_in]
        elif axis == 'y':
            y = yc[k_in]
        elif axis == 'x':
            x = xc[k_in]
        tp = rg.Point3d(o.X + x, o.Y + y, o.Z + z)      # label point (on the slice)
        i, j, k = cell_of(xe, x), cell_of(ye, y), cell_of(ze, max(z, 0.0))
        if axis == 'z':
            k = k_in
        elif axis == 'y':
            j = k_in
        elif axis == 'x':
            i = k_in
        note = ''
        outside = not (xe[0] <= x <= xe[-1] and ye[0] <= y <= ye[-1] and z <= ze[-1])
        if outside:
            i = j = k = None
        elif not is_air(i, j, k):
            hit = nearest_air(x, y, z, i, j, k) if skip_bldg else None
            if hit:
                i, j, k = hit
                note = ' (nearest air cell)'
            else:
                i = j = k = None
        path = GH_Path(n)
        if i is None:
            vtree.AddRange([None] * len(idx), path)
            fv.append(None)
            cl.append(None)
            ij.append(None)
            ds.append(None)
            lb.append('P%d outside model domain' % n if outside else 'P%d inside building' % n)
            lv.append('')
            tps.append(tp)
            tbl.append('%d,%.2f,%.2f,%.2f,,,,,' % (n, p.X, p.Y, p.Z) + ','.join([''] * len(idx)))
            continue
        q = k * n2 + j * nx + i
        vals = [float(d[q]) if d[q] > NODATA + 1 else None for d in data]
        c = rg.Point3d(o.X + xc[i], o.Y + yc[j], o.Z + zc[k])
        vtree.AddRange(vals, path)
        fv.append(vals[0])
        cl.append(c)
        ij.append('%d,%d,%d' % (i, j, k))
        ds.append(tp.DistanceTo(c))
        lines = [('%s: %s %s' % (s, (fmt % v) if v is not None else '-', u)).rstrip()
                 for s, v, u in zip(short, vals, units)]
        lb.append('\n'.join(['P%d [%d,%d,%d]%s' % (n, i, j, k, note)] + lines))
        lv.append('\n'.join((('%s %s' % ((fmt % v) if v is not None else '-', u)).strip())
                            for v, u in zip(vals, units)))
        tps.append(tp)
        tbl.append('%d,%.2f,%.2f,%.2f,%d,%d,%d,%.2f,' % (n, p.X, p.Y, p.Z, i, j, k, ds[-1])
                   + ','.join((fmt % v) if v is not None else '' for v in vals))

    if csv_path:
        with io.open(csv_path, 'w', encoding='utf-8-sig') as f:   # Excel reads ° correctly
            f.write(u'\n'.join(tbl))

    print('%d points | variables: %s' % (len(pts_in), ', '.join(uvars)))
    return vnames, xc, yc, zc, uvars, vtree, fv, cl, ij, ds, lb, lv, tps, tbl


if run_on:
    (var_names, x_levels, y_levels, z_levels, used_vars, values, first_vals,
     cells, ijk, dist, labels, labels_val, tag_pts, table) = run()
else:
    print('Set _run to True to run.')
# ---------- end point_probe ----------
wind_vectors = Python3Script()  # -> out, x_levels, y_levels, z_levels, arrows, values, points, vectors, speeds; inputs edx: String, axis: String, k: Int32, step: Int32, scale: Double, vmax: Double, origin: Point3d, run: Boolean
# ---------- wind_vectors: Python ----------
"""ENVI-met EDX/EDT -> wind vectors (arrows) for Grasshopper / Ladybug
Runs in GhPython (IronPython 2.7, Rhino 7) and Python 3 (Rhino 8).
Reads the "Flow u", "Flow v", "Flow w" variables (m/s) from the atmosphere output.

Inputs (Type hint):
    _run    : bool    - set to True to run (connect a Boolean Toggle / Button)
    _edx    : str     - path to the .EDX file (the .EDT file must share its name and folder)
    _axis_  : str     - "z" (plan, default), "x" (YZ section), "y" (XZ section)
    _k      : int     - cell index along _axis_ (z: level, x: column i, y: row j)
    _step_  : int     - sample every n cells (default 2) so arrows are not too dense
    _scale_ : float   - arrow length factor (default 1.0)
    _vmax_  : float   - reference speed (m/s). Fix this value when comparing scenarios;
                        leave empty = use the slice maximum
    _origin_: Point3d - model origin in Rhino (optional)
Outputs:
    x_levels, y_levels, z_levels : cell-centre coordinates (m) - use to pick _k
    arrows  : arrow mesh -> connect to _mesh of LB Spatial Heatmap
    values  : wind speed per face -> connect to _values of LB Spatial Heatmap
    points  : arrow anchor points    } use with Grasshopper's
    vectors : wind vectors (m/s)     } Vector Display component if desired
    speeds  : speed at each point (m/s)
"""
import re
import os
import math
from array import array
import Rhino.Geometry as rg

NODATA = -999.0

TIPS_IN = {
    '_run': 'bool - True = read the file and build the arrows.\n'
            'False = do nothing, all outputs empty (default). Connect a Boolean Toggle / Button.',
    '_edx': 'str - full path to the ENVI-met ATMOSPHERE .EDX file\n'
            '(must contain Flow u / Flow v / Flow w). The .EDT file must have the same name and folder.',
    '_axis_': 'str (optional) - section plane:\n"z" = plan (default)\n"x" = vertical section in the YZ plane\n'
              '"y" = vertical section in the XZ plane',
    '_k': 'int - cell index along _axis_ (z: level, x: column i, y: row j).\n'
          'Use x_levels / y_levels / z_levels to find the index of a height or position. Default 0.',
    '_step_': 'int (optional) - sample every n-th cell in the section plane so arrows are not\n'
              'too dense (vertical direction of x / y sections is always every cell). Default 2.',
    '_scale_': 'float (optional) - multiplier for arrow length and width. Default 1.0.',
    '_vmax_': 'float (optional) - reference speed (m/s): an arrow of this speed is ~0.9 cell long\n'
              '(capped at 1.5x). Fix it when comparing scenarios; empty = maximum of this slice.',
    '_origin_': 'Point3d (optional) - position of the ENVI-met model origin in Rhino. Default (0,0,0).',
}
TIPS_OUT = {
    'x_levels': 'Cell-centre x coordinates (m) - pick _k for _axis_ = "x".',
    'y_levels': 'Cell-centre y coordinates (m) - pick _k for _axis_ = "y".',
    'z_levels': 'Cell-centre heights (m) - pick _k for _axis_ = "z" (plan level).',
    'arrows': 'Flat arrow mesh in the section plane (2 faces per arrow: shaft + head),\n'
              'length ~ in-plane speed -> _mesh of the Heatmap / LB Spatial Heatmap.',
    'values': 'In-plane wind speed (m/s) per mesh face (2 per arrow)\n'
              '-> _values of the Heatmap / LB Spatial Heatmap (List Access).',
    'points': 'Cell centre of every sampled cell (incl. calm cells without an arrow).',
    'vectors': 'Full 3D wind vector (u, v, w) in m/s at each point -> Vector Display.',
    'speeds': 'Full 3D wind speed (m/s) at each point.',
}


def set_tooltips(tips_in, tips_out, comp_desc=None):
    """write the tooltip (Description) of every input / output of this component.
    Matched by NickName; only changed when different, so it costs nothing after the first run"""
    try:
        comp = ghenv.Component  # noqa: F821
    except NameError:
        return
    try:
        if comp_desc and comp.Description != comp_desc:
            comp.Description = comp_desc
        for plist, tips in ((comp.Params.Input, tips_in), (comp.Params.Output, tips_out)):
            for p in plist:
                t = tips.get(p.NickName) or tips.get(p.Name)
                if t and p.Description != t:
                    p.Description = t
    except Exception as ex:                              # tooltips must never break the solve
        print('tooltips not set: %s' % ex)


set_tooltips(TIPS_IN, TIPS_OUT,
             'Meerkat - wind arrows from ENVI-met Flow u / v / w on a plan or section')


# ---------- optional inputs: runs even if they are not created on the component ----------
def opt(name, default=None):
    v = globals().get(name, default)
    return default if v is None else v


_run = opt('_run', False)
_axis_ = opt('_axis_', 'z')
_k = opt('_k', 0)
_step_ = opt('_step_', 2)
_scale_ = opt('_scale_', 1.0)
_vmax_ = opt('_vmax_', None)
_origin_ = opt('_origin_', None)

# outputs stay empty until _run is True
x_levels = y_levels = z_levels = None
arrows = values = points = vectors = speeds = None


# ---------- EDX header helpers ----------
def tag(txt, name):
    m = re.search(r'<%s>(.*?)</%s>' % (name, name), txt, re.S | re.I)
    return m.group(1).strip() if m else None


def floats(s):
    return [float(v) for v in s.replace('\n', ',').split(',') if v.strip()]


def edges(spacing):
    e = [0.0]
    for d in spacing:
        e.append(e[-1] + d)
    return e


def centers(e):
    return [(e[i] + e[i + 1]) / 2.0 for i in range(len(e) - 1)]


def norm(s):
    return re.sub(r'[^a-z0-9]', '', s.lower())


def run():
    # ---------- read the EDX header ----------
    with open(_edx, 'rb') as f:
        txt = f.read().decode('latin-1')

    nx = int(tag(txt, 'nr_xdata'))
    ny = int(tag(txt, 'nr_ydata'))
    nz = int(tag(txt, 'nr_zdata'))
    dxs = floats(tag(txt, 'spacing_x'))
    dys = floats(tag(txt, 'spacing_y'))
    dzs = floats(tag(txt, 'spacing_z'))
    xl = centers(edges(dxs))
    yl = centers(edges(dys))
    zl = centers(edges(dzs))
    var_names = [s.strip() for s in tag(txt, 'name_variables').split(',') if s.strip()]

    def find_var(prefix):
        for i, n in enumerate(var_names):
            if norm(n).startswith(prefix):
                return i
        raise ValueError('Variable "%s" not found in EDX. Is this an atmosphere output?' % prefix)

    iu, iv, iw = find_var('flowu'), find_var('flowv'), find_var('floww')

    # ---------- parameters ----------
    axis = (_axis_ or 'z').strip().lower()
    k = int(_k) if _k is not None else 0
    step = max(1, int(_step_)) if _step_ else 2
    scale = float(_scale_) if _scale_ else 1.0
    limit = {'x': nx, 'y': ny, 'z': nz}[axis]
    if not 0 <= k < limit:
        raise ValueError('_k must be in the range 0..%d for axis %s' % (limit - 1, axis))

    # ---------- read EDT (float32 LE, variable -> z -> y -> x) ----------
    n2 = nx * ny
    edt = os.path.splitext(_edx)[0] + '.EDT'
    if not os.path.exists(edt):
        edt = os.path.splitext(_edx)[0] + '.edt'

    def read(offset, count):
        with open(edt, 'rb') as f:
            f.seek(offset * 4)
            buf = f.read(count * 4)
        a = array('f')
        try:
            a.frombytes(buf)
        except AttributeError:
            a.fromstring(buf)
        return a

    if axis == 'z':
        U = read((iu * nz + k) * n2, n2)
        V = read((iv * nz + k) * n2, n2)
        W = read((iw * nz + k) * n2, n2)
        idx = lambda i, j, kk: j * nx + i
    else:
        U = read(iu * nz * n2, nz * n2)
        V = read(iv * nz * n2, nz * n2)
        W = read(iw * nz * n2, nz * n2)
        idx = lambda i, j, kk: kk * n2 + j * nx + i

    # ---------- collect samples on the slice ----------
    # each sample: (cell centre, full 3D vector, vector projected onto the section plane, cell size)
    o = _origin_ if _origin_ else rg.Point3d(0, 0, 0)
    samples = []

    if axis == 'z':
        plane_n = rg.Vector3d.ZAxis
        cells = [(i, j, k) for j in range(0, ny, step) for i in range(0, nx, step)]
    elif axis == 'x':
        plane_n = rg.Vector3d.XAxis
        cells = [(k, j, kk) for kk in range(0, nz, 1) for j in range(0, ny, step)]
    else:
        plane_n = rg.Vector3d.YAxis
        cells = [(i, k, kk) for kk in range(0, nz, 1) for i in range(0, nx, step)]

    for (i, j, kk) in cells:
        n = idx(i, j, kk)
        u, v, w = U[n], V[n], W[n]
        if u <= NODATA + 1 or v <= NODATA + 1 or w <= NODATA + 1:
            continue                                    # building / no-data cell
        full = rg.Vector3d(u, v, w)
        if axis == 'z':
            proj = rg.Vector3d(u, v, 0)
            cell = min(dxs[i], dys[j]) * step
        elif axis == 'x':
            proj = rg.Vector3d(0, v, w)
            cell = min(dys[j] * step, dzs[kk])
        else:
            proj = rg.Vector3d(u, 0, w)
            cell = min(dxs[i] * step, dzs[kk])
        c = rg.Point3d(o.X + xl[i], o.Y + yl[j], o.Z + zl[kk])
        samples.append((c, full, proj, cell))

    if not samples:
        raise ValueError('No valid cells on this slice.')

    vmax = float(_vmax_) if _vmax_ else max(s[2].Length for s in samples)
    vmax = vmax if vmax > 1e-9 else 1.0

    # ---------- build arrows ----------
    mesh = rg.Mesh()
    vals, pts, vecs, spds = [], [], [], []

    def add_arrow(c, d, side, L, width, spd):
        """flat arrow lying in the section plane, centred at c, direction d (unit)"""
        tail = c - d * (L / 2.0)
        tip = c + d * (L / 2.0)
        hl = min(0.35 * L, 1.2 * width * 2.5)          # arrowhead length
        neck = tip - d * hl
        sw, hw = width * 0.35, width                   # shaft / head width
        vs = mesh.Vertices
        a = vs.Count
        for p in (tail - side * sw, tail + side * sw, neck + side * sw, neck - side * sw,
                  neck + side * hw, tip, neck - side * hw):
            vs.Add(p)
        mesh.Faces.AddFace(a, a + 1, a + 2, a + 3)     # shaft
        mesh.Faces.AddFace(a + 4, a + 5, a + 6)        # head
        vals.extend([spd, spd])

    for c, full, proj, cell in samples:
        spd = proj.Length
        pts.append(c)
        vecs.append(full)
        spds.append(full.Length)
        if spd < 1e-6:
            continue
        d = rg.Vector3d(proj)
        d.Unitize()
        side = rg.Vector3d.CrossProduct(plane_n, d)
        side.Unitize()
        L = 0.9 * cell * scale * min(spd / vmax, 1.5)
        width = 0.18 * cell * scale
        add_arrow(c, d, side, L, width, spd)

    mesh.Normals.ComputeNormals()
    mesh.Compact()
    print('Axis %s, index %d | %d arrows | vmax = %.2f m/s' % (axis, k, len(vals) // 2, vmax))
    return xl, yl, zl, mesh, vals, pts, vecs, spds


if _run:
    x_levels, y_levels, z_levels, arrows, values, points, vectors, speeds = run()
else:
    print('Set _run to True to run.')
# ---------- end wind_vectors ----------
streamline_colors = Python3Script()  # -> out, mesh, segments, seg_colors, seg_speeds, legend, legend_pts, legend_txt, v_range; inputs curves: list of Curve, edx: String, vmin: Double, vmax: Double, plane: String, colors: list, radius: Double, sides: Int32, legend_pt: Point3d, legend_scale: Double, title_xz: Boolean, legend_h: Double, legend_w: Double, legend_n: Int32, origin: Point3d
# ---------- streamline_colors: Python ----------
"""Colour streamlines by wind speed (ENVI-met EDX/EDT) for Grasshopper
Runs in GhPython (IronPython 2.7, Rhino 7) and Python 3 (Rhino 8).

Takes the `curves` output of envimet_wind_3d.py (or any curves inside the model),
samples wind speed from the ENVI-met file at every curve vertex and returns
smooth vertex-coloured tubes plus a legend. Shares the data cache with
envimet_wind_3d.py, so the EDT file is not read twice.

Performance notes (v2):
  - curve vertices are read as one block copy per curve (no per-point .NET calls)
  - trilinear lookup uses direct index on uniform grids (bisect only for telescoping z)
  - colours come from a 256-step lookup table (no Color object per vertex)
  - the tube mesh is handed to Rhino in one block copy (vertices, faces, colours)
  - segments (Line objects) are only built when that output is connected;
    seg_colors / seg_speeds only when one of them is connected
  - the building mask of the shared data cache is built with one comprehension

Inputs (only _curves and _edx are required):
    _run        : bool         - True = read the file and build; False = do nothing (file not
                                 read, all outputs empty). Boolean Toggle; default True
    _curves     : list Curve   - streamlines (LIST ACCESS)
    _edx        : str          - path to the .EDX file (.EDT with same name, same folder)
    _vmin_      : float        - speed at the bottom of the colour scale (default: data min)
    _vmax_      : float        - speed at the top of the colour scale (default: data max);
                                 fix _vmin_/_vmax_ when comparing scenarios
    _plane_     : str          - "x" / "y" / "z": ignore the velocity component normal to
                                 that slice (use for 2D-slice streamlines); empty = 3D speed
    _colors_    : list Colour  - custom gradient (LIST ACCESS); default = Ladybug palette
    _radius_    : float        - tube radius in m (default 0.15)
    _sides_     : int          - tube sides (default 6)
    _legend_pt_ : Point3d      - base point of the legend (default: right of the curves)
    _legend_scale_: float      - size multiplier for the whole legend (bar + text), default 1.0
    _legend_h_  : float        - legend bar height in m (overrides the automatic height)
    _legend_w_  : float        - legend bar width in m (default: height x 0.075)
    _legend_n_  : int          - number of value labels on the legend (default 6)
    _title_xz_  : bool         - True = legend (bar, value labels, title) stands upright in the
                                 vertical XZ plane; legend_pts then become PLANES. Default False
    _origin_    : Point3d      - model origin in Rhino (same as in envimet_wind_3d.py)
Outputs:
    mesh        : vertex-coloured tube mesh (shows coloured in the Grasshopper preview;
                  bake it to keep the colours)
    segments    : line segments            } for Custom Preview / Gradient workflows
    seg_colors  : colour of each segment   }
    seg_speeds  : speed of each segment (m/s)
    legend      : vertex-coloured legend bar mesh
    legend_pts, legend_txt : label points and texts -> Text Tag 3D component
                  (planes in the XZ plane when _title_xz_ is True)
    text_size   : suggested text height -> Size input of Text Tag 3D (scales with the legend)
    v_range     : (vmin, vmax) used
"""
import re
import os
import math
import time
import bisect
from array import array
import Rhino.Geometry as rg
import scriptcontext as sc
import System
import System.Drawing as sd
from System.Runtime.InteropServices import GCHandle, GCHandleType, Marshal

NODATA = -999.0
LB_COLORS = [(75, 107, 169), (115, 147, 202), (170, 200, 247), (193, 213, 208),
             (245, 239, 103), (252, 230, 74), (239, 156, 21), (234, 123, 0),
             (234, 74, 0), (234, 38, 0)]


TIPS_IN = {
    '_run': 'bool - True = read the file and build; False = do nothing\n'
            '(file not read, all outputs empty). Connect a Boolean Toggle. Default True.',
    '_curves': 'list Curve - streamlines to colour, e.g. curves output of envimet_wind3d\n'
               '(any curves inside the model work). Set this input to LIST ACCESS.',
    '_edx': 'str - full path to the ENVI-met ATMOSPHERE .EDX file (Flow u / v / w).\n'
            'The .EDT file must have the same name and folder. Shares the data cache with envimet_wind3d.',
    '_vmin_': 'float (optional) - speed (m/s) at the bottom of the colour scale. Default: data minimum.\n'
              'Fix _vmin_ / _vmax_ when comparing scenarios.',
    '_vmax_': 'float (optional) - speed (m/s) at the top of the colour scale. Default: data maximum.',
    '_plane_': 'str (optional) - "x" / "y" / "z": ignore the velocity component normal to that slice\n'
               '(use the same value as for 2D-slice streamlines); empty = full 3D speed.',
    '_colors_': 'list Colour (optional, LIST ACCESS) - custom gradient from low to high.\n'
                'Default: Ladybug palette.',
    '_radius_': 'float (optional) - tube radius (m). Default 0.15.',
    '_sides_': 'int (optional) - number of tube sides (min 3). Default 6.',
    '_legend_pt_': 'Point3d (optional) - base point (bottom-left) of the legend. Default: right of the curves.',
    '_legend_scale_': 'float (optional) - size multiplier for the whole legend (bar + text). Default 1.0.',
    '_legend_h_': 'float (optional) - legend bar height (m); overrides the automatic height\n'
                  '(0.4 x bounding-box diagonal of the curves).',
    '_legend_w_': 'float (optional) - legend bar width (m). Default: bar height x 0.075.',
    '_legend_n_': 'int (optional) - number of value labels on the legend (min 2). Default 6.',
    '_title_xz_': 'bool (optional) - True = the legend (bar, value labels, title) stands upright in\n'
                  'the vertical XZ plane (text faces -Y, reads along +X, up = +Z), e.g. for sections or\n'
                  '3D views. legend_pts then output PLANES - connect them to the Location of Text Tag 3D\n'
                  'as before. Default False (flat in XY).',
    '_origin_': 'Point3d (optional) - position of the ENVI-met model origin in Rhino\n'
                '(use the same value as in envimet_wind3d). Default (0,0,0).',
}
TIPS_OUT = {
    'mesh': 'Vertex-coloured tube mesh with a smooth speed gradient. Coloured in the\n'
            'Grasshopper preview; bake it to keep the colours.',
    'segments': 'Line segments between curve vertices -> Custom Preview / gradient workflows.\n'
                'Built only when this output is connected (saves time).',
    'seg_colors': 'Colour of each segment (same order as segments).',
    'seg_speeds': 'Wind speed (m/s) of each segment (mean of its two end points).',
    'legend': 'Vertex-coloured legend bar mesh.',
    'legend_pts': 'Positions of the legend labels + title -> Location of Text Tag 3D.\n'
                  'Points (flat XY) or planes (upright XZ, _title_xz_ = True).',
    'legend_txt': 'Legend label texts + title "Wind speed (m/s)" -> Text of Text Tag 3D.',
    'text_size': 'Suggested text height (scales with the legend) -> Size of Text Tag 3D.',
    'v_range': '(vmin, vmax) actually used for the colours.',
}


def set_tooltips(tips_in, tips_out, comp_desc=None):
    """write the tooltip (Description) of every input / output of this component.
    Matched by NickName; only changed when different, so it costs nothing after the first run"""
    try:
        comp = ghenv.Component  # noqa: F821
    except NameError:
        return
    try:
        if comp_desc and comp.Description != comp_desc:
            comp.Description = comp_desc
        for plist, tips in ((comp.Params.Input, tips_in), (comp.Params.Output, tips_out)):
            for p in plist:
                t = tips.get(p.NickName) or tips.get(p.Name)
                if t and p.Description != t:
                    p.Description = t
    except Exception as ex:                              # tooltips must never break the solve
        print('tooltips not set: %s' % ex)


set_tooltips(TIPS_IN, TIPS_OUT,
             'Meerkat - colour streamlines by ENVI-met wind speed: smooth coloured tubes + legend')


def opt(name, default=None):
    v = globals().get(name, default)
    return default if v is None or v == [] else v


run = bool(opt('_run', True))
curves_in = opt('_curves', [])
if not isinstance(curves_in, (list, tuple)):
    curves_in = [curves_in]
curves_in = [c for c in curves_in if c is not None]
vmin_in, vmax_in = opt('_vmin_', None), opt('_vmax_', None)
plane = str(opt('_plane_', '')).strip().lower()
cols_in = opt('_colors_', None)
radius = float(opt('_radius_', 0.15))
sides = max(3, int(opt('_sides_', 6)))
legend_pt = opt('_legend_pt_', None)
legend_scale = float(opt('_legend_scale_', 1.0))
legend_h_in = opt('_legend_h_', None)
legend_w_in = opt('_legend_w_', None)
legend_n = max(2, int(opt('_legend_n_', 6)))
_xz = opt('_title_xz_', False)
title_xz = (_xz.strip().lower() not in ('false', '0', 'no', 'off', '')) if isinstance(_xz, str) \
    else bool(_xz)
o = opt('_origin_', rg.Point3d(0, 0, 0))
ox, oy, oz = o.X, o.Y, o.Z
if run and not curves_in:
    raise ValueError('Connect _curves (set the input to List Access).')

palette = [(c.R, c.G, c.B) for c in cols_in] if cols_in else LB_COLORS
if not isinstance(palette, list) or len(palette) < 2:
    palette = LB_COLORS


# =============== 0. BULK .NET HELPERS ===============
def _pin_copy_to(arr, flat, net_type):
    src = System.Array[net_type](flat)
    h = GCHandle.Alloc(arr, GCHandleType.Pinned)
    try:
        Marshal.Copy(src, 0, h.AddrOfPinnedObject(), len(flat))
    finally:
        h.Free()


def point_array(flat):
    """flat [x, y, z, ...] -> Point3d[] with one memory copy"""
    n = len(flat) // 3
    arr = System.Array.CreateInstance(rg.Point3d, n)
    if n:
        try:
            _pin_copy_to(arr, flat, System.Double)
        except Exception:
            for i in range(n):
                arr[i] = rg.Point3d(flat[3 * i], flat[3 * i + 1], flat[3 * i + 2])
    return arr


def face_array(flat):
    """flat [a, b, c, d, ...] -> MeshFace[] with one memory copy"""
    n = len(flat) // 4
    arr = System.Array.CreateInstance(rg.MeshFace, n)
    if n:
        try:
            _pin_copy_to(arr, flat, System.Int32)
        except Exception:
            for i in range(n):
                arr[i] = rg.MeshFace(*flat[4 * i:4 * i + 4])
    return arr


def points_xyz(arr):
    """Point3d[] -> flat Python list [x, y, z, ...] with one memory copy"""
    n = arr.Length
    if not n:
        return []
    try:
        dbl = System.Array.CreateInstance(System.Double, 3 * n)
        h = GCHandle.Alloc(arr, GCHandleType.Pinned)
        try:
            Marshal.Copy(h.AddrOfPinnedObject(), dbl, 0, 3 * n)
        finally:
            h.Free()
        return list(dbl)
    except Exception:
        out = []
        for p in arr:
            out.extend((p.X, p.Y, p.Z))
        return out


def output_wanted(*names):
    """True if one of these outputs is connected (or when not running in Grasshopper)"""
    try:
        outs = ghenv.Component.Params.Output  # noqa: F821
    except NameError:
        return True
    for p in outs:
        if p.NickName in names and p.Recipients.Count > 0:
            return True
    return False


# =============== 1. LOAD DATA (shared cache with envimet_wind_3d.py) ===============
def tag(txt, name):
    m = re.search(r'<%s>(.*?)</%s>' % (name, name), txt, re.S | re.I)
    return m.group(1).strip() if m else None


def floats(s):
    return [float(v) for v in s.replace('\n', ',').split(',') if v.strip()]


def centers(sp):
    c, e = [], 0.0
    for d in sp:
        c.append(e + d / 2.0)
        e += d
    return c


def norm(s):
    return re.sub(r'[^a-z0-9]', '', s.lower())


def read(path, offset, count):
    with open(path, 'rb') as f:
        f.seek(offset * 4)
        buf = f.read(count * 4)
    a = array('f')
    try:
        a.frombytes(buf)
    except AttributeError:
        a.fromstring(buf)
    return a


def load(edx, edt):
    with open(edx, 'rb') as f:
        txt = f.read().decode('latin-1')
    d = {}
    d['nx'], d['ny'], d['nz'] = [int(tag(txt, t)) for t in ('nr_xdata', 'nr_ydata', 'nr_zdata')]
    d['dxs'], d['dys'], d['dzs'] = [floats(tag(txt, t)) for t in ('spacing_x', 'spacing_y', 'spacing_z')]
    names = [s.strip() for s in tag(txt, 'name_variables').split(',') if s.strip()]

    def find(prefix):
        for i, n in enumerate(names):
            if norm(n).startswith(prefix):
                return i
        raise ValueError('Variable "%s" not found. Is this an atmosphere output?' % prefix)

    n3 = d['nx'] * d['ny'] * d['nz']
    U = read(edt, find('flowu') * n3, n3)
    V = read(edt, find('flowv') * n3, n3)
    W = read(edt, find('floww') * n3, n3)
    lim = NODATA + 1                                    # 1 = building / no-data
    S = bytearray([1 if (a <= lim or b <= lim or c <= lim) else 0 for a, b, c in zip(U, V, W)])
    d['U'], d['V'], d['W'], d['S'] = U, V, W, S
    return d


def make_locator(cs, sp):
    """coordinate -> (index i, fraction t), clamped to the grid (same as the v1 clamp_loc)"""
    n = len(cs)
    c0, c1 = cs[0], cs[-1]
    if max(sp) - min(sp) < 1e-6:                        # uniform grid: direct index
        inv = 1.0 / sp[0]
        last = n - 2

        def loc(x):
            if x <= c0:
                return 0, 0.0
            if x >= c1:
                return last, 1.0
            f = (x - c0) * inv
            i = int(f)
            if i > last:
                i = last
            return i, f - i
    else:                                               # non-uniform (telescoping z): bisect
        def loc(x):
            if x <= c0:
                return 0, 0.0
            if x >= c1:
                return n - 2, 1.0
            i = min(max(bisect.bisect_right(cs, x) - 1, 0), n - 2)
            return i, (x - cs[i]) / (cs[i + 1] - cs[i])
    return loc


def make_lut(pal):
    n = len(pal) - 1
    lut = []
    for s in range(256):
        t = s / 255.0 * n
        i = min(int(t), n - 1)
        f = t - i
        a, b = pal[i], pal[i + 1]
        lut.append(sd.Color.FromArgb(int(a[0] + (b[0] - a[0]) * f),
                                     int(a[1] + (b[1] - a[1]) * f),
                                     int(a[2] + (b[2] - a[2]) * f)))
    return lut


def build():
    t0 = time.time()
    edt_path = os.path.splitext(_edx)[0] + '.EDT'
    if not os.path.exists(edt_path):
        edt_path = os.path.splitext(_edx)[0] + '.edt'
    key = (_edx, os.path.getmtime(_edx), os.path.getmtime(edt_path))
    cache = sc.sticky.get('envimet_wind3d_cache')
    if not cache or cache.get('key') != key:
        cache = load(_edx, edt_path)
        cache['key'] = key
        sc.sticky['envimet_wind3d_cache'] = cache
    t_load = time.time() - t0

    nx, ny = cache['nx'], cache['ny']
    U, V, W, S = cache['U'], cache['V'], cache['W'], cache['S']
    dxs, dys, dzs = cache['dxs'], cache['dys'], cache['dzs']
    xc, yc, zc = centers(dxs), centers(dys), centers(dzs)
    n2 = nx * ny
    locx, locy, locz = make_locator(xc, dxs), make_locator(yc, dys), make_locator(zc, dzs)
    keep_u, keep_v, keep_w = plane != 'x', plane != 'y', plane != 'z'
    sqrt = math.sqrt

    # =============== 2. SPEED AT A POINT (trilinear, skips building cells) ===============
    def speed_at(x, y, z):
        i, tx = locx(x - ox)
        j, ty = locy(y - oy)
        k, tz = locz(z - oz)
        b = k * n2 + j * nx + i
        sx, sy, sz = 1.0 - tx, 1.0 - ty, 1.0 - tz
        u = v = w = ws = 0.0
        for q, wt in ((b, sx * sy * sz), (b + 1, tx * sy * sz),
                      (b + nx, sx * ty * sz), (b + nx + 1, tx * ty * sz),
                      (b + n2, sx * sy * tz), (b + n2 + 1, tx * sy * tz),
                      (b + n2 + nx, sx * ty * tz), (b + n2 + nx + 1, tx * ty * tz)):
            if wt > 0.0 and not S[q]:                   # renormalise over valid cells
                u += wt * U[q]
                v += wt * V[q]
                w += wt * W[q]
                ws += wt
        if ws < 1e-9:
            return None
        s2 = 0.0
        if keep_u:
            s2 += u * u
        if keep_v:
            s2 += v * v
        if keep_w:
            s2 += w * w
        return sqrt(s2) / ws

    # =============== 3. CURVE VERTICES + SPEEDS ===============
    step_len = max(0.5, radius * 3)

    def curve_xyz(c):
        try:
            ok, pl = c.TryGetPolyline()
        except Exception:
            ok, pl = False, None
        if ok and pl is not None and pl.Count >= 2:
            return points_xyz(pl.ToArray())
        ts = c.DivideByLength(step_len, True)
        pts = [c.PointAt(t) for t in ts] if ts else [c.PointAtStart, c.PointAtEnd]
        out = []
        for p in pts:
            out.extend((p.X, p.Y, p.Z))
        return out

    lines = []                                          # (flat xyz, speeds) per curve
    xmin = ymin = zmin = 1e300
    xmax = ymax = zmax = -1e300
    for c in curves_in:
        xyz = curve_xyz(c)
        n = len(xyz) // 3
        if n < 1:
            continue
        spd = [speed_at(xyz[3 * m], xyz[3 * m + 1], xyz[3 * m + 2]) for m in range(n)]
        last = next((s for s in spd if s is not None), 0.0)   # fill gaps (wall-adjacent points)
        filled = []
        for s in spd:
            if s is not None:
                last = s
            filled.append(last)
        lines.append((xyz, filled))
        xs, ys, zs = xyz[0::3], xyz[1::3], xyz[2::3]
        xmin, xmax = min(xmin, min(xs)), max(xmax, max(xs))
        ymin, ymax = min(ymin, min(ys)), max(ymax, max(ys))
        zmin, zmax = min(zmin, min(zs)), max(zmax, max(zs))
    if not lines:
        raise ValueError('No usable curves.')

    all_s = [s for _, ss in lines for s in ss]
    vmin = float(vmin_in) if vmin_in is not None else min(all_s)
    vmax = float(vmax_in) if vmax_in is not None else max(all_s)
    if vmax - vmin < 1e-9:
        vmax = vmin + 1e-6
    v_range = (vmin, vmax)
    lut = make_lut(palette)
    span = 255.0 / (vmax - vmin)

    def color(s):
        q = int((s - vmin) * span + 0.5)
        return lut[0 if q < 0 else (255 if q > 255 else q)]

    # =============== 4. COLOURED TUBES (vertex colours, smooth gradient) ===============
    angles = [(math.cos(2 * math.pi * s / sides), math.sin(2 * math.pi * s / sides))
              for s in range(sides)]
    ring_faces = [(s, (s + 1) % sides) for s in range(sides)]
    vflat, fflat, vcols = [], [], []
    vext, fext, cext = vflat.extend, fflat.extend, vcols.extend
    want_lines = output_wanted('segments')              # Line objects are the costly part
    want_seg = want_lines or output_wanted('seg_colors', 'seg_speeds')
    segments, seg_colors, seg_speeds = [], [], []
    Line = rg.Line

    for xyz, spd in lines:
        n = len(xyz) // 3
        if n < 2:
            continue
        base = len(vflat) // 3
        rings = 0
        for m in range(n):
            a3, b3 = 3 * max(m - 1, 0), 3 * min(m + 1, n - 1)   # central-difference tangent
            dx, dy, dz = xyz[b3] - xyz[a3], xyz[b3 + 1] - xyz[a3 + 1], xyz[b3 + 2] - xyz[a3 + 2]
            l = sqrt(dx * dx + dy * dy + dz * dz)
            if l < 1e-9:
                continue
            dx, dy, dz = dx / l, dy / l, dz / l
            if abs(dz) < 0.9:                           # frame: e1 = d x Z (or d x X)
                e1x, e1y, e1z = dy, -dx, 0.0
            else:
                e1x, e1y, e1z = 0.0, dz, -dy
            le = sqrt(e1x * e1x + e1y * e1y + e1z * e1z)
            e1x, e1y, e1z = e1x / le, e1y / le, e1z / le
            e2x, e2y, e2z = dy * e1z - dz * e1y, dz * e1x - dx * e1z, dx * e1y - dy * e1x
            px, py, pz = xyz[3 * m], xyz[3 * m + 1], xyz[3 * m + 2]
            for ca, sa in angles:
                vext((px + radius * (e1x * ca + e2x * sa),
                      py + radius * (e1y * ca + e2y * sa),
                      pz + radius * (e1z * ca + e2z * sa)))
            cext([color(spd[m])] * sides)
            rings += 1
        for r in range(rings - 1):
            a0, a1 = base + r * sides, base + (r + 1) * sides
            for s, s1 in ring_faces:
                fext((a0 + s, a0 + s1, a1 + s1, a1 + s))
        if want_seg:
            for m in range(n - 1):
                sv = 0.5 * (spd[m] + spd[m + 1])
                if want_lines:
                    q = 3 * m
                    segments.append(Line(xyz[q], xyz[q + 1], xyz[q + 2],
                                         xyz[q + 3], xyz[q + 4], xyz[q + 5]))
                seg_colors.append(color(sv))
                seg_speeds.append(sv)

    mesh = rg.Mesh()
    mesh.Vertices.AddVertices(point_array(vflat))
    mesh.Faces.AddFaces(face_array(fflat))
    mesh.VertexColors.SetColors(System.Array[sd.Color](vcols))
    mesh.Normals.ComputeNormals()

    # =============== 5. LEGEND ===============
    bb = rg.BoundingBox(xmin, ymin, zmin, xmax, ymax, zmax)
    diag = bb.Diagonal.Length or 1.0
    h = float(legend_h_in) if legend_h_in else 0.4 * diag
    h *= legend_scale
    w = float(legend_w_in) * legend_scale if legend_w_in else 0.075 * h
    text_size = 0.5 * w
    lp = legend_pt if legend_pt else rg.Point3d(bb.Max.X + 0.05 * diag, bb.Min.Y, bb.Min.Z)

    def P(u, v):
        """legend coordinates (u = right, v = up) -> world (x, y, z), flat XY or upright XZ"""
        if title_xz:
            return (lp.X + u, lp.Y, lp.Z + v)
        return (lp.X + u, lp.Y + v, lp.Z)

    nseg = 20
    lv, lf, lc = [], [], []
    for s in range(nseg + 1):
        y = h * s / float(nseg)
        col = color(vmin + (vmax - vmin) * s / float(nseg))
        lv.extend(P(0.0, y) + P(w, y))
        lc.extend((col, col))
        if s:
            a = 2 * (s - 1)
            lf.extend((a, a + 1, a + 3, a + 2))
    legend = rg.Mesh()
    legend.Vertices.AddVertices(point_array(lv))
    legend.Faces.AddFaces(face_array(lf))
    legend.VertexColors.SetColors(System.Array[sd.Color](lc))
    legend.Normals.ComputeNormals()
    legend_pts, legend_txt = [], []
    nl = legend_n - 1
    for s in range(legend_n):
        legend_pts.append(rg.Point3d(*P(1.5 * w, h * s / float(nl))))
        legend_txt.append('%.2f' % (vmin + (vmax - vmin) * s / float(nl)))
    legend_pts.append(rg.Point3d(*P(0.0, h + 1.5 * text_size)))
    legend_txt.append('Wind speed (m/s)')
    if title_xz:                                        # Text Tag 3D needs planes to stand up
        legend_pts = [rg.Plane(p, rg.Vector3d.XAxis, rg.Vector3d.ZAxis) for p in legend_pts]

    nsegs = sum(len(x) // 3 - 1 for x, _ in lines)
    print('%d curves | %d segments%s | speed %.2f-%.2f m/s | load %.2fs | total %.2fs'
          % (len(lines), nsegs, '' if want_seg else ' (segment outputs not connected: skipped)',
             vmin, vmax, t_load, time.time() - t0))
    return dict(mesh=mesh, segments=segments, seg_colors=seg_colors, seg_speeds=seg_speeds,
                legend=legend, legend_pts=legend_pts, legend_txt=legend_txt, v_range=v_range,
                text_size=text_size)


OUTS = ('mesh', 'segments', 'seg_colors', 'seg_speeds', 'legend', 'legend_pts',
        'legend_txt', 'v_range', 'text_size')
if run:
    result = build()
else:
    print('_run is False - nothing read, outputs empty')
    result = dict((n, None) for n in OUTS)
mesh, segments, seg_colors = result['mesh'], result['segments'], result['seg_colors']
seg_speeds, legend, v_range = result['seg_speeds'], result['legend'], result['v_range']
legend_pts, legend_txt = result['legend_pts'], result['legend_txt']
text_size = result['text_size']
# ---------- end streamline_colors ----------
palette_2 = ValueList({"ladybug", "thermal", "turbo", "rdylbu", "spectral", "coolwarm", "rdbu", "viridis", "magma", "inferno"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}, selected="bupu")
color_palette = Python3Script(palette=palette_2)  # -> out, colors, names, preview; inputs n: Int32, pt: Point3d
# ---------- color_palette: Python ----------
"""Meerkat palette: modern colour palettes for heatmaps / streamlines
Runs in GhPython (IronPython 2.7, Rhino 7) and Python 3 (Rhino 8).

Outputs a list of colours that can be connected to any _colors_ input
(envimet_heatmap.py, envimet_streamline_colors.py, LB Legend Parameters _colors_).

Inputs (all optional):
    _palette_ : str / int - palette (default "viridis"). Leave it unconnected: a drop-down
                            list with all 70 palettes is created. Also accepts a name ("_r" =
                            reversed) or an index 0-69 from a Number Slider
    _reverse_ : bool  - reverse the palette (default False)
    _n_       : int   - number of output colours (default 11; resampled smoothly)
    _pt_      : Point3d - base point of the preview swatches (default origin)
Outputs:
    colors    : list of colours (low -> high)
    names     : all available palette names
    preview   : mesh with one coloured strip per palette (name order = names)
"""

# ---- tooltips (shown when hovering inputs / outputs in Grasshopper) ----------------------
COMPONENT_DESC = 'Meerkat palette: modern colour palettes for heatmaps / streamlines'
INPUT_TIPS = {'_palette_': 'palette (default "viridis"). Leave it unconnected: a drop-down list with all 70 '
                  'palettes is created. Also accepts a name ("_r" = reversed) or an index 0-69 '
                  'from a Number Slider [str / int]',
     '_reverse_': 'reverse the palette (default False) [bool]',
     '_n_': 'number of output colours (default 11; resampled smoothly) [int]',
     '_pt_': 'base point of the preview swatches (default origin) [Point3d]'}
OUTPUT_TIPS = {'colors': 'list of colours (low -> high)',
     'names': 'all available palette names',
     'preview': 'mesh with one coloured strip per palette (name order = names)'}


def _apply_tooltips():
    try:
        comp = ghenv.Component
    except Exception:
        return                                        # not running inside Grasshopper
    try:
        if COMPONENT_DESC and comp.Description != COMPONENT_DESC:
            comp.Description = COMPONENT_DESC
        for params, tips in ((comp.Params.Input, INPUT_TIPS), (comp.Params.Output, OUTPUT_TIPS)):
            for p in params:
                tip = tips.get(p.NickName) or tips.get(p.Name)
                if tip and p.Description != tip:
                    p.Description = tip
    except Exception:
        pass


_apply_tooltips()
# ---------------------------------------------------------------------------------------
import Rhino.Geometry as rg
import System.Drawing as sd

# ---- colour palettes (low -> high). Add "_r" to a name to reverse it, e.g. "viridis_r".
# viridis/magma/inferno/plasma/cividis/turbo: matplotlib (CC0 / Apache 2.0);
# rdylbu/spectral/rdbu/ylorrd/blues: ColorBrewer (Apache 2.0, Cynthia Brewer);
# coolwarm: K. Moreland; ladybug: Ladybug Tools default; thermal, wind, dusk, delta: Meerkat;
# puor/brbg/piyg/prgn: ColorBrewer; vlag/icefire: seaborn (BSD); berlin: F. Crameri (via
# matplotlib); bwr: matplotlib.
PALETTES = {
    'ladybug': [(75, 107, 169), (115, 147, 202), (170, 200, 247), (193, 213, 208), (245, 239, 103),
                (252, 230, 74), (239, 156, 21), (234, 123, 0), (234, 74, 0), (234, 38, 0)],
    'viridis': [(68, 1, 84), (72, 36, 117), (65, 68, 135), (53, 95, 141), (42, 120, 142), (33, 145, 140),
                (34, 168, 132), (68, 191, 112), (122, 209, 81), (189, 223, 38), (253, 231, 37)],
    'magma': [(0, 0, 4), (20, 14, 54), (59, 15, 112), (100, 26, 128), (140, 41, 129), (183, 55, 121),
              (222, 73, 104), (247, 112, 92), (254, 159, 109), (254, 207, 146), (252, 253, 191)],
    'inferno': [(0, 0, 4), (22, 11, 57), (66, 10, 104), (106, 23, 110), (147, 38, 103), (188, 55, 84),
                (221, 81, 58), (243, 120, 25), (252, 165, 10), (246, 215, 70), (252, 255, 164)],
    'plasma': [(13, 8, 135), (65, 4, 157), (106, 0, 168), (143, 13, 164), (177, 42, 144), (204, 71, 120),
               (225, 100, 98), (242, 132, 75), (252, 166, 54), (252, 206, 37), (240, 249, 33)],
    'cividis': [(0, 34, 78), (8, 51, 112), (53, 69, 108), (79, 87, 108), (102, 105, 112), (125, 124, 120),
                (148, 142, 119), (174, 163, 113), (200, 184, 102), (229, 207, 82), (254, 232, 56)],
    'turbo': [(48, 18, 59), (69, 89, 203), (62, 155, 254), (25, 213, 205), (70, 248, 132), (164, 252, 60),
              (225, 221, 55), (254, 164, 49), (240, 91, 18), (195, 37, 3), (122, 4, 3)],
    'rdylbu': [(49, 54, 149), (69, 116, 179), (116, 173, 209), (170, 216, 233), (224, 243, 248),
               (255, 254, 190), (254, 224, 144), (253, 173, 96), (244, 109, 67), (214, 47, 39), (165, 0, 38)],
    'spectral': [(94, 79, 162), (51, 135, 188), (102, 194, 165), (170, 220, 164), (230, 245, 152),
                 (255, 254, 190), (254, 224, 139), (253, 173, 96), (244, 109, 67), (212, 61, 79), (158, 1, 66)],
    'coolwarm': [(59, 76, 192), (89, 119, 227), (123, 159, 249), (158, 190, 255), (192, 212, 245),
                 (221, 220, 220), (242, 203, 183), (247, 172, 142), (238, 132, 104), (214, 82, 68), (180, 4, 38)],
    'rdbu': [(5, 48, 97), (32, 101, 171), (67, 147, 195), (144, 196, 221), (209, 229, 240), (247, 246, 246),
             (253, 219, 199), (243, 164, 129), (214, 96, 77), (177, 24, 43), (103, 0, 31)],
    'ylorrd': [(255, 255, 204), (255, 241, 169), (254, 225, 135), (254, 202, 102), (254, 171, 73),
               (253, 140, 60), (252, 91, 46), (237, 46, 33), (212, 16, 32), (176, 0, 38), (128, 0, 38)],
    'blues': [(247, 251, 255), (227, 238, 249), (208, 225, 242), (183, 212, 234), (148, 196, 223),
              (106, 174, 214), (74, 152, 201), (46, 126, 188), (23, 100, 171), (8, 74, 145), (8, 48, 107)],
    'thermal': [(23, 55, 94), (40, 98, 145), (72, 148, 170), (146, 197, 190), (232, 226, 196),
                (244, 190, 124), (229, 128, 77), (196, 64, 56), (128, 20, 46)],
    'wind': [(245, 250, 250), (200, 232, 230), (140, 205, 205), (70, 165, 180), (35, 120, 160),
             (30, 75, 130), (25, 40, 90)],
    'dusk': [(44, 30, 80), (92, 55, 125), (150, 70, 140), (205, 96, 120), (240, 140, 110),
             (250, 196, 132), (252, 240, 170)],
    # ---- diverging (for differences / comparisons around 0): negative = cool, positive = warm
    'delta': [(17, 72, 110), (39, 116, 156), (98, 166, 190), (170, 210, 220), (232, 242, 244),
              (250, 248, 245), (250, 224, 210), (240, 170, 140), (214, 106, 82), (168, 50, 48),
              (110, 18, 34)],
    'vlag': [(35, 105, 189), (91, 132, 189), (135, 160, 196), (175, 188, 209), (217, 220, 229),
             (250, 245, 244), (236, 211, 210), (219, 171, 168), (204, 133, 130), (187, 94, 93),
             (169, 55, 59)],
    'puor': [(45, 0, 75), (83, 38, 135), (128, 115, 172), (177, 170, 209), (216, 218, 235),
             (247, 247, 246), (254, 224, 182), (252, 183, 97), (224, 130, 20), (178, 87, 6),
             (127, 59, 8)],
    'brbg': [(0, 60, 48), (1, 101, 93), (53, 151, 143), (127, 204, 192), (199, 234, 229),
             (245, 245, 244), (246, 232, 195), (222, 193, 123), (191, 129, 45), (139, 80, 10),
             (84, 48, 5)],
    'piyg': [(142, 1, 82), (196, 26, 124), (222, 119, 174), (241, 181, 217), (253, 224, 239),
             (247, 247, 246), (230, 245, 208), (183, 224, 133), (127, 188, 65), (76, 145, 33),
             (39, 100, 25)],
    'prgn': [(64, 0, 75), (117, 41, 130), (153, 112, 171), (193, 164, 206), (231, 212, 232),
             (246, 247, 246), (217, 240, 211), (165, 218, 159), (90, 174, 97), (26, 119, 54),
             (0, 68, 27)],
    'icefire': [(189, 231, 219), (117, 184, 206), (56, 133, 208), (74, 79, 165), (48, 46, 74),
                (31, 30, 30), (74, 37, 46), (147, 46, 68), (211, 73, 54), (241, 143, 81),
                (255, 212, 172)],
    'berlin': [(158, 176, 255), (98, 166, 224), (50, 128, 166), (32, 82, 106), (17, 39, 50),
               (25, 12, 9), (55, 16, 0), (97, 32, 11), (150, 74, 54), (202, 123, 113),
               (255, 173, 173)],
    'bwr': [(0, 0, 255), (50, 50, 255), (102, 102, 255), (152, 152, 255), (204, 204, 255),
            (255, 254, 254), (255, 204, 204), (255, 152, 152), (255, 102, 102), (255, 50, 50),
            (255, 0, 0)],
    # ---- Meerkat originals
    'urban_heat': [(52, 73, 94), (84, 110, 122), (130, 150, 150), (190, 190, 170), (235, 215, 170),
                   (240, 180, 120), (225, 130, 80), (190, 80, 60), (130, 40, 45)],
    'sunrise': [(25, 35, 80), (70, 55, 130), (150, 70, 150), (220, 90, 120), (250, 135, 90),
                (252, 190, 90), (252, 240, 160)],
    'ocean': [(8, 29, 58), (16, 62, 104), (23, 104, 140), (30, 145, 160), (80, 185, 175),
              (160, 220, 200), (230, 248, 240)],
    'forest': [(20, 40, 25), (35, 75, 40), (60, 110, 55), (100, 145, 70), (150, 180, 95),
               (205, 215, 140), (245, 245, 200)],
    'aurora': [(20, 20, 50), (40, 60, 120), (30, 130, 150), (60, 190, 140), (170, 225, 110),
               (245, 240, 140)],
    'neon': [(15, 10, 40), (80, 20, 140), (190, 30, 170), (255, 70, 120), (255, 150, 60),
             (255, 230, 80)],
    'heat_grey': [(225, 225, 225), (200, 200, 200), (170, 170, 170), (200, 150, 130),
                  (225, 110, 80), (200, 50, 40), (140, 20, 30)],
    'utci': [(0, 32, 96), (0, 64, 160), (0, 112, 224), (64, 160, 255), (160, 208, 255),
             (102, 189, 99), (254, 224, 139), (253, 174, 97), (244, 109, 67), (215, 48, 39),
             (140, 10, 30)],
    # ---- more perceptual / sequential / diverging (seaborn BSD, cmocean MIT, ColorBrewer
    #      Apache 2.0, matplotlib)
    'rocket': [(3, 5, 26), (37, 20, 51), (76, 29, 75), (117, 31, 88), (161, 26, 91), (203, 27, 79),
               (232, 63, 63), (243, 113, 77), (246, 156, 115), (247, 198, 166), (250, 235, 221)],
    'mako': [(11, 4, 5), (37, 23, 41), (56, 42, 84), (65, 63, 128), (57, 93, 156), (53, 123, 163),
             (52, 151, 169), (62, 180, 173), (96, 206, 172), (169, 225, 189), (222, 245, 229)],
    'flare': [(75, 35, 98), (98, 41, 106), (122, 46, 112), (146, 51, 113), (170, 58, 110),
              (194, 65, 103), (214, 79, 95), (226, 101, 92), (231, 126, 99), (235, 152, 114),
              (237, 176, 129)],
    'crest': [(44, 49, 114), (40, 67, 123), (33, 85, 132), (28, 102, 137), (36, 118, 139),
              (52, 133, 141), (68, 148, 143), (87, 164, 144), (109, 178, 144), (137, 191, 145),
              (165, 205, 144)],
    'cmo_thermal': [(4, 35, 51), (15, 50, 106), (64, 52, 159), (103, 67, 150), (139, 83, 141),
                    (177, 95, 130), (214, 108, 108), (243, 130, 77), (252, 166, 60),
                    (247, 208, 69), (232, 250, 91)],
    'cmo_solar': [(51, 20, 24), (82, 30, 34), (115, 39, 36), (143, 52, 31), (165, 74, 23),
                  (182, 100, 19), (196, 127, 21), (207, 156, 29), (216, 186, 42), (222, 219, 58),
                  (225, 253, 75)],
    'cmo_matter': [(47, 15, 62), (79, 22, 82), (114, 26, 96), (147, 32, 99), (179, 46, 95),
                   (207, 68, 86), (226, 98, 83), (238, 133, 94), (245, 167, 115), (250, 202, 144),
                   (254, 237, 176)],
    'cmo_amp': [(241, 237, 236), (229, 207, 201), (220, 177, 163), (211, 149, 127), (202, 119, 91),
                (192, 88, 59), (179, 56, 38), (157, 25, 38), (127, 14, 41), (92, 14, 33),
                (60, 9, 18)],
    'cmo_haline': [(42, 24, 108), (41, 39, 162), (13, 78, 150), (24, 102, 140), (45, 124, 137),
                   (60, 147, 135), (74, 170, 129), (101, 193, 114), (148, 211, 93),
                   (208, 224, 109), (253, 239, 154)],
    'cmo_ice': [(4, 6, 19), (27, 27, 55), (48, 47, 95), (61, 67, 137), (62, 94, 169),
                (66, 123, 183), (82, 150, 193), (107, 177, 203), (140, 203, 214), (188, 228, 231),
                (234, 253, 253)],
    'cmo_deep': [(40, 26, 44), (56, 45, 81), (65, 64, 123), (62, 90, 146), (64, 117, 152),
                 (72, 143, 158), (82, 168, 163), (102, 194, 164), (146, 216, 164), (202, 235, 178),
                 (253, 254, 204)],
    'cmo_dense': [(230, 241, 241), (188, 220, 229), (150, 197, 226), (123, 173, 228),
                  (115, 144, 227), (120, 113, 213), (121, 84, 187), (116, 58, 152), (104, 36, 113),
                  (83, 21, 70), (54, 14, 36)],
    'cmo_speed': [(255, 253, 205), (238, 223, 152), (216, 197, 95), (184, 178, 47), (142, 162, 11),
                  (95, 146, 12), (50, 128, 31), (15, 107, 43), (16, 84, 44), (25, 59, 35),
                  (23, 35, 19)],
    'cmo_tempo': [(255, 246, 244), (220, 223, 208), (182, 203, 175), (141, 185, 151),
                  (93, 167, 134), (42, 147, 127), (17, 125, 121), (24, 101, 110), (28, 77, 97),
                  (26, 54, 81), (21, 29, 68)],
    'cmo_algae': [(215, 249, 208), (184, 227, 172), (150, 205, 138), (114, 187, 108),
                  (68, 168, 85), (18, 148, 80), (9, 125, 75), (21, 102, 65), (26, 80, 52),
                  (24, 58, 37), (18, 36, 20)],
    'cmo_rain': [(238, 237, 243), (222, 211, 201), (203, 186, 152), (161, 172, 130),
                 (115, 157, 117), (61, 142, 110), (12, 123, 110), (8, 99, 107), (30, 75, 95),
                 (37, 51, 75), (34, 27, 56)],
    'cmo_turbid': [(233, 246, 171), (219, 217, 135), (207, 188, 102), (196, 161, 77),
                   (181, 135, 64), (161, 112, 59), (138, 94, 58), (112, 77, 55), (86, 62, 48),
                   (59, 47, 39), (34, 31, 27)],
    'cmo_balance': [(24, 28, 67), (41, 62, 151), (22, 112, 188), (89, 156, 187), (170, 194, 203),
                    (241, 236, 235), (220, 178, 164), (202, 118, 91), (179, 56, 38), (126, 14, 41),
                    (60, 9, 18)],
    'cmo_curl': [(21, 29, 68), (28, 77, 96), (17, 125, 121), (92, 167, 134), (182, 203, 176),
                 (253, 245, 244), (230, 184, 162), (211, 118, 105), (174, 64, 96), (117, 25, 93),
                 (52, 13, 53)],
    'cmo_diff': [(8, 35, 64), (33, 77, 106), (90, 116, 135), (141, 156, 167), (198, 202, 207),
                 (246, 241, 240), (206, 199, 184), (161, 150, 121), (122, 109, 65), (75, 71, 28),
                 (28, 34, 7)],
    'cmo_tarn': [(23, 35, 14), (60, 77, 13), (132, 106, 37), (203, 132, 72), (227, 191, 163),
                 (252, 247, 246), (203, 204, 170), (124, 164, 144), (46, 126, 126), (21, 79, 106),
                 (16, 30, 79)],
    'reds': [(255, 245, 240), (254, 229, 216), (253, 202, 181), (252, 171, 143), (252, 138, 106),
             (251, 105, 74), (241, 68, 50), (217, 37, 35), (188, 20, 26), (152, 12, 19),
             (103, 0, 13)],
    'oranges': [(255, 245, 235), (254, 233, 212), (253, 217, 180), (253, 195, 141), (253, 167, 98),
                (253, 140, 59), (243, 112, 27), (226, 85, 8), (197, 65, 2), (158, 51, 3),
                (127, 39, 4)],
    'greens': [(247, 252, 245), (233, 247, 229), (211, 238, 205), (184, 227, 178), (152, 213, 148),
               (115, 196, 118), (75, 176, 98), (47, 151, 78), (21, 127, 59), (0, 100, 40),
               (0, 68, 27)],
    'purples': [(252, 251, 253), (242, 240, 247), (226, 226, 239), (206, 207, 229),
                (182, 182, 216), (158, 154, 200), (134, 131, 189), (114, 98, 172), (97, 64, 155),
                (79, 31, 139), (63, 0, 125)],
    'greys': [(255, 255, 255), (243, 243, 243), (226, 226, 226), (206, 206, 206), (181, 181, 181),
              (149, 149, 149), (122, 122, 122), (95, 95, 95), (64, 64, 64), (29, 29, 29),
              (0, 0, 0)],
    'orrd': [(255, 247, 236), (254, 235, 208), (253, 220, 175), (253, 202, 148), (253, 178, 123),
             (252, 140, 89), (242, 109, 75), (224, 68, 47), (201, 29, 19), (168, 0, 0),
             (127, 0, 0)],
    'ylgnbu': [(255, 255, 217), (241, 250, 186), (214, 239, 179), (171, 222, 183), (115, 200, 189),
               (64, 181, 196), (36, 152, 193), (32, 114, 177), (35, 77, 160), (31, 47, 135),
               (8, 29, 88)],
    'ylgn': [(255, 255, 229), (249, 253, 194), (229, 245, 172), (200, 233, 155), (162, 216, 138),
             (119, 198, 121), (76, 176, 99), (47, 147, 77), (21, 121, 62), (0, 96, 52),
             (0, 69, 41)],
    'gnbu': [(247, 252, 240), (229, 245, 224), (212, 238, 206), (190, 230, 191), (159, 218, 184),
             (122, 204, 196), (87, 184, 208), (56, 155, 198), (29, 126, 183), (8, 95, 163),
             (8, 64, 129)],
    'pubugn': [(255, 247, 251), (240, 231, 242), (219, 216, 234), (192, 201, 226), (153, 185, 217),
               (102, 169, 207), (64, 149, 195), (22, 135, 159), (2, 121, 118), (1, 100, 81),
               (1, 70, 54)],
    'bupu': [(247, 252, 253), (229, 239, 246), (204, 221, 236), (178, 202, 225), (154, 180, 214),
             (140, 149, 198), (140, 116, 181), (138, 81, 165), (133, 45, 144), (118, 12, 113),
             (77, 0, 75)],
    'rdpu': [(255, 247, 243), (253, 229, 226), (252, 208, 204), (251, 182, 188), (249, 148, 177),
             (247, 103, 161), (226, 62, 153), (192, 21, 136), (153, 1, 123), (111, 1, 116),
             (73, 0, 106)],
    'cubehelix': [(0, 0, 0), (26, 20, 47), (22, 61, 78), (30, 101, 66), (84, 121, 47),
                  (161, 121, 74), (208, 126, 147), (207, 157, 219), (193, 202, 243),
                  (211, 238, 239), (255, 255, 255)],
    'managua': [(255, 207, 103), (224, 159, 87), (193, 116, 73), (160, 81, 62), (119, 51, 57),
                (87, 41, 73), (76, 61, 115), (81, 99, 162), (95, 137, 195), (111, 182, 226),
                (129, 231, 255)],
    'vanimo': [(255, 205, 253), (216, 137, 202), (173, 83, 154), (116, 46, 100), (51, 23, 44),
               (26, 21, 19), (35, 44, 20), (65, 90, 31), (98, 135, 47), (138, 188, 83),
               (190, 253, 165)],
    'rdgy': [(26, 26, 26), (76, 76, 76), (135, 135, 135), (185, 185, 185), (224, 224, 224),
             (255, 254, 254), (253, 219, 199), (243, 164, 129), (214, 96, 77), (177, 24, 43),
             (103, 0, 31)],
}


def get_palette(name):
    """palette name (optionally with '_r') -> list of (r, g, b); None if unknown"""
    key = str(name or '').strip().lower().replace(' ', '').replace('-', '')
    rev = key.endswith('_r')
    if rev:
        key = key[:-2]
    pal = PALETTES.get(key)
    if pal is None:
        return None
    return list(reversed(pal)) if rev else list(pal)


PALETTE_ORDER = ['ladybug', 'thermal', 'turbo', 'rdylbu', 'spectral', 'coolwarm', 'rdbu',
                 'viridis', 'magma', 'inferno', 'plasma', 'cividis', 'ylorrd', 'dusk',
                 'wind', 'blues',
                 # diverging, index 16-24
                 'delta', 'vlag', 'puor', 'brbg', 'piyg', 'prgn', 'icefire', 'berlin', 'bwr',
                 # Meerkat originals, index 25-32
                 'urban_heat', 'sunrise', 'ocean', 'forest', 'aurora', 'neon', 'heat_grey', 'utci',
                 # perceptual, index 33-36
                 'rocket', 'mako', 'flare', 'crest',
                 # cmocean, index 37-53
                 'cmo_thermal', 'cmo_solar', 'cmo_matter', 'cmo_amp', 'cmo_haline', 'cmo_ice',
                 'cmo_deep', 'cmo_dense', 'cmo_speed', 'cmo_tempo', 'cmo_algae', 'cmo_rain',
                 'cmo_turbid', 'cmo_balance', 'cmo_curl', 'cmo_diff', 'cmo_tarn',
                 # ColorBrewer sequential, index 54-65
                 'reds', 'oranges', 'greens', 'purples', 'greys', 'orrd', 'ylgnbu', 'ylgn', 'gnbu',
                 'pubugn', 'bupu', 'rdpu',
                 # other, index 66-69
                 'cubehelix', 'managua', 'vanimo', 'rdgy']
DIVERGING = set(['delta', 'vlag', 'puor', 'brbg', 'piyg', 'prgn', 'icefire', 'berlin', 'bwr',
                 'rdbu', 'coolwarm', 'rdylbu', 'spectral', 'cmo_balance', 'cmo_curl',
                 'cmo_diff', 'cmo_tarn', 'managua', 'vanimo', 'rdgy'])


def palette_from_input(v, default):
    """accepts a name ("viridis", "viridis_r") or an index (0, 1, ... from a slider)"""
    if v is None or str(v).strip() == '':
        return default
    try:
        i = int(float(v))
        return PALETTE_ORDER[i % len(PALETTE_ORDER)]
    except (ValueError, TypeError):
        return str(v)


def auto_value_list(input_name, items, width=150):
    """If the input is not connected, drop a Value List (drop-down) with the given items
    next to it and wire it up - so options are picked from a menu instead of typed."""
    try:
        import System
        import Grasshopper as gh
        comp = ghenv.Component
    except Exception:
        return                                          # not running inside Grasshopper
    param = None
    for p in comp.Params.Input:
        if p.NickName == input_name or p.Name == input_name:
            param = p
    if param is None or param.SourceCount > 0:
        return
    doc = comp.OnPingDocument()
    if doc is None:
        return

    def make(d):
        if param.SourceCount > 0:
            return
        vl = gh.Kernel.Special.GH_ValueList()
        vl.CreateAttributes()
        vl.ListItems.Clear()
        for it in items:
            vl.ListItems.Add(gh.Kernel.Special.GH_ValueListItem(it, '"%s"' % it))
        vl.ListMode = gh.Kernel.Special.GH_ValueListMode.DropDown
        vl.NickName = input_name.strip('_')
        grip = param.Attributes.InputGrip
        vl.Attributes.Pivot = System.Drawing.PointF(grip.X - width - 30, grip.Y - 11)
        d.AddObject(vl, False)
        param.AddSource(vl)
        param.ExpireSolution(False)

    doc.ScheduleSolution(5, gh.Kernel.GH_Document.GH_ScheduleDelegate(make))



def opt(name, default=None):
    v = globals().get(name, default)
    return default if v is None or v == [] else v


def resample(pal, n):
    out = []
    for s in range(n):
        t = s / float(max(n - 1, 1)) * (len(pal) - 1)
        i = min(int(t), len(pal) - 2)
        f = t - i
        a, b = pal[i], pal[i + 1]
        out.append(sd.Color.FromArgb(int(round(a[0] + (b[0] - a[0]) * f)),
                                     int(round(a[1] + (b[1] - a[1]) * f)),
                                     int(round(a[2] + (b[2] - a[2]) * f))))
    return out


auto_value_list('_palette_', PALETTE_ORDER)
name = palette_from_input(opt('_palette_', None), 'viridis')
n = max(2, int(opt('_n_', 11)))
o = opt('_pt_', rg.Point3d(0, 0, 0))
pal = get_palette(name)
if pal is None:
    raise ValueError('Unknown palette "%s". Use one of: %s (add "_r" to reverse).'
                     % (name, ', '.join(sorted(PALETTES))))
if bool(opt('_reverse_', False)):
    pal = list(reversed(pal))
colors = resample(pal, n)
names = list(PALETTE_ORDER)

# preview: one horizontal strip per palette, 10 x 1 units, 0.4 gap
preview = rg.Mesh()
steps = 32
for r, nm in enumerate(names):  # strip r = slider index r
    cs = resample(PALETTES[nm], steps + 1)
    y0 = o.Y - r * 1.4
    for s in range(steps):
        a = preview.Vertices.Count
        x0, x1 = o.X + 10.0 * s / steps, o.X + 10.0 * (s + 1) / steps
        for (x, y), c in (((x0, y0), cs[s]), ((x1, y0), cs[s + 1]),
                          ((x1, y0 + 1), cs[s + 1]), ((x0, y0 + 1), cs[s])):
            preview.Vertices.Add(x, y, o.Z)
            preview.VertexColors.Add(c)
        preview.Faces.AddFace(a, a + 1, a + 2, a + 3)
preview.Normals.ComputeNormals()
print('%s -> %d colours' % (name, n))
# ---------- end color_palette ----------
